# Grasshopper definition 170810_201_DesignComputation_v040_AG.ghx (Grasshopper 0.9.76)
# plug-ins: Python Interpreter

# ---- group: First Floor (0)
pipeline = GeometryPipeline(
    GroupByLayer=False,
    GroupByType=False,
    IncludeHidden=True,
    IncludeLocked=True,
    LayerFilter="Interior_0",
    NameFilter="*",
    TypeFilter=1073741849)
pipeline_2 = GeometryPipeline(
    GroupByLayer=False,
    GroupByType=False,
    IncludeHidden=True,
    IncludeLocked=True,
    LayerFilter="Exterior_0",
    NameFilter="*",
    TypeFilter=1073741849)

# NEST
pipeline_ribs = GeometryPipeline(
    GroupByLayer=False,
    GroupByType=False,
    IncludeHidden=True,
    IncludeLocked=True,
    LayerFilter="Ribs",
    NameFilter="*",
    TypeFilter=1073741853)
pipeline_3 = GeometryPipeline(
    GroupByLayer=False,
    GroupByType=False,
    IncludeHidden=True,
    IncludeLocked=True,
    LayerFilter="Wall_Openings_0",
    NameFilter="*",
    TypeFilter=1073741849)
brep_wall_openings = Brep(pipeline_3)
brep_exterior_walls = Brep(pipeline_2)
brep_interior_walls = Brep(pipeline)
crv_ribs = Curve(pipeline_ribs)

# ---- group: Second Floor (1)
pipeline_4 = GeometryPipeline(
    GroupByLayer=False,
    GroupByType=False,
    IncludeHidden=True,
    IncludeLocked=True,
    LayerFilter="Interior_1",
    NameFilter="*",
    TypeFilter=1073741849)
pipeline_5 = GeometryPipeline(
    GroupByLayer=False,
    GroupByType=False,
    IncludeHidden=True,
    IncludeLocked=True,
    LayerFilter="Exterior_1",
    NameFilter="*",
    TypeFilter=1073741849)
pipeline_6 = GeometryPipeline(
    GroupByLayer=False,
    GroupByType=False,
    IncludeHidden=True,
    IncludeLocked=True,
    LayerFilter="Wall_Openings_1",
    NameFilter="*",
    TypeFilter=1073741849)
brep_exterior_walls_2 = Brep(pipeline_5)
brep_interior_walls_2 = Brep(pipeline_4)
brep_wall_openings_2 = Brep(pipeline_6)

# ---- group: Third Floor (2)
pipeline_7 = GeometryPipeline(
    GroupByLayer=False,
    GroupByType=False,
    IncludeHidden=True,
    IncludeLocked=True,
    LayerFilter="Interior_2",
    NameFilter="*",
    TypeFilter=1073741849)
pipeline_8 = GeometryPipeline(
    GroupByLayer=False,
    GroupByType=False,
    IncludeHidden=True,
    IncludeLocked=True,
    LayerFilter="Exterior_2",
    NameFilter="*",
    TypeFilter=1073741849)
brep_exterior_walls_3 = Brep(pipeline_8)
brep_interior_walls_3 = Brep(pipeline_7)

# ----
python = PythonScript()  # -> out, a
# ---------- python: Python ----------
import rhinoscriptsyntax as rs


rs.AddPoint((0,0,0))
# ---------- end python ----------
wind_pts = Point([<point referenced from the Rhino model> x2])

# ---- group: Fourth Floor (3)
pipeline_9 = GeometryPipeline(
    GroupByLayer=False,
    GroupByType=False,
    IncludeHidden=True,
    IncludeLocked=True,
    LayerFilter="Interior_3",
    NameFilter="*",
    TypeFilter=1073741849)
pipeline_10 = GeometryPipeline(
    GroupByLayer=False,
    GroupByType=False,
    IncludeHidden=True,
    IncludeLocked=True,
    LayerFilter="Exterior_3",
    NameFilter="*",
    TypeFilter=1073741849)
brep_exterior_walls_4 = Brep(pipeline_10)
brep_interior_walls_4 = Brep(pipeline_9)

# ----
# Input Sliders
exterior_bay = Slider(800, range=200..1500)
interior_bay = Slider(800, range=200..1500)
interior_beam_dim = Panel("[80,80]")
exterior_beam_dim = Panel("[80,160]")

# ---- group: Generate Support Pts
scx_interior = SurfaceCurve(Surface=brep_interior_walls, Curve=graft(crv_ribs))  # -> Curves, flatten(Points), UVPoints, Normals, Parameters, Tangents
scx_exterior = SurfaceCurve(Surface=brep_exterior_walls, Curve=graft(crv_ribs))  # -> Curves, flatten(Points), UVPoints, Normals, Parameters, Tangents
pt = Point([scx_interior.Points, scx_exterior.Points])

# ----
stat_z_level = Point(<point referenced from the Rhino model>)
pdecon = Deconstruct(Point=stat_z_level)  # -> XComponent, YComponent, ZComponent
building_z_level = Panel(pdecon.ZComponent)
panel = Panel("C:\Users\gandiaa\Documents\projects\spatial_timber_assemblies\main\main.py")
beams = BooleanToggle(True)
structure = BooleanToggle(False)

init_button = Button()
reload = PythonScript(init=init_button)  # -> out, a; inputs init: Boolean
# ---------- reload: Python ----------
from spatial_timber_assemblies.useful.import_or_reload import *

if init:
    module_name = "geometry_generation"
    reload_lib(module_name)
    
    module_name = "geometry_generation.wall.py"
    reload_lib(module_name)
    
    module_name = "geometry_generation.building.py"
    reload_lib(module_name)
    
    module_name = "geometry_generation.helper_functions.py"
    reload_lib(module_name)
    
    reload_lib("spatial_timber_assemblies.main")
# ---------- end reload ----------

file = ReadFile(F=panel, PerLineParse=False)  # -> C
#   port F: Uri of file to read
# ---------- file: VB line parser ----------
    action = GH_LineParserAction.Include
    Return line

    'Parse the line and return some data that represents the line.
    'If the line cannot be parsed, you can return Nothing and
    'assign a different action.
    'The default implementation is to just return the line itself.
    'If you return types that implement IGH_Goo, this component
    'will work substantially faster.
# ---------- end file ----------

# ---- group: Python
ative = BooleanToggle(True)
python_2 = PythonScript(
    Code=file,
    Building_z_level=building_z_level,
    Wind_pts_list=wind_pts,
    Ex_wall_srfs_0=brep_exterior_walls,
    In_wall_srfs_0=brep_interior_walls,
    Wall_opening_srfs_0=brep_wall_openings,
    Ex_wall_srfs_1=brep_exterior_walls_2,
    In_wall_srfs_1=brep_interior_walls_2,
    Wall_opening_srfs_1=brep_wall_openings_2,
    Ex_wall_srfs_2=brep_exterior_walls_3,
    In_wall_srfs_2=brep_interior_walls_3,
    Ex_wall_srfs_3=brep_exterior_walls_4,
    In_wall_srfs_3=brep_interior_walls_4,
    Interior_bay=interior_bay,
    Exterior_bay=exterior_bay,
    Interior_beam_dim=interior_beam_dim,
    Exterior_beam_dim=exterior_beam_dim,
    Active=ative,
    Gen_beams=beams,
    Analyse_str=structure)  # -> A, Edges, Vertices, Edges_lines, Beams, Init_axis_lines, Beams_axis_lines, Interior_bars_lines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

# ----
brep = Brep(python_2.Rafters)
crv = Curve(python_2.Edges_lines)
crv_2 = Curve(python_2.Interior_bars_lines)
crv_3 = Curve(python_2.Beams_axis_lines)
crv_4 = Curve(python_2.Init_axis_lines)
crv_5 = Curve(python_2.Wall_faces)
pt_2 = Point(python_2.A)
# Tolerance analysis
# Lines ordered as the beams(input)
crv_6 = Curve([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])
# Lines are randomly drawn by hand. They are used to stablish connectivity
crv_7 = Curve([<curve referenced from the Rhino model> x166])
python_3 = PythonScript()  # -> out, beams
# ---------- python_3: Python ----------
import pickle
import os
import tolerance_analysis

basedir = os.path.dirname(tolerance_analysis.__file__)
datadir = os.path.join(basedir, 'data')

if os.path.exists(datadir):
    filename = os.path.join(datadir, 'experiment-2.pickle')
    
    with open(filename, "r") as file:
        beams = pickle.load(file)
else:
    raise ValueError('No data folder found')
# ---------- end python_3 ----------
save_to_file = BooleanToggle(False)
cull_error_beams = CullIndex(List=python_3.beams, Indices=[30, 39, 44, 46], Wrap=True)
list = ValueList({"0", "1", "2", "3", "4", "5", "6", "7", "8", "9"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}, selected="5")
python_4 = PythonScript(beams=python_2.Beams, save_to_file=save_to_file)  # -> out, a; inputs beams: list
# ---------- python_4: Python ----------
import pickle
import os
import tolerance_analysis

if save_to_file:
    basedir = os.path.dirname(tolerance_analysis.__file__)
    datadir = os.path.join(basedir, 'data')
    
    if not os.path.exists(datadir):
        os.mkdir(datadir)
    
    filename = os.path.join(datadir, 'experiment-2.pickle')
    
    with open(filename, "w") as file:
        pickle.dump(beams,file)

    print('Done')
# ---------- end python_4 ----------
generate_beam_number = PythonScript(edges=crv_6, generate=Toggle(False))  # -> out, a, b; inputs edges: list of Curve, generate: Boolean
# ---------- generate_beam_number: Python ----------
from compas_fab.fab.geometry import Frame, Transformation
from compas.geometry.elements import Line
from compas.geometry.elements import Point
from compas.geometry.elements import Vector
import rhinoscriptsyntax as rs
import Rhino.Geometry as rg
import scriptcontext as sc
print generate
if generate==True:
    for index, edge in enumerate(edges):
        rs.AddTextDot(str(index),rs.CurveMidPoint(edge))
    #    generated_textDot_list.append(rs.AddTextDot("0",rs.CurveMidPoint(edge)))
# ---------- end generate_beam_number ----------
python_5 = PythonScript(beams=cull_error_beams)  # -> beams_srf, beams_length; inputs beams: list
# ---------- python_5: Python ----------
import rhinoscriptsyntax as rs
beams_srf = []
beams_length = []
for beam in beams:
    # print rs.coercesurface(beam_inst.polysurface)
    #print beam.polysurface
    #print rs.coercebrep(beam.polysurface)
    beams_srf.append(rs.coercebrep(beam.polysurface))
    beams_length.append(rs.Distance(beam.axis_end_points[0],beam.axis_end_points[1]))

# print beam_polysurfaces
# print beams_srf
# ---------- end python_5 ----------
python_6 = PythonScript(beams=cull_error_beams, edges=crv_6, joints=crv_7, selected_beam=list, generate_TextDot=Toggle(False))  # -> assembly_sequence, topology_edges, beam_mesh; inputs beams: list, edges: list of Curve, joints: list of Curve, selected_beam: Int32
# ---------- python_6: Python ----------
from tolerance_analysis import ToleranceNetwork
from compas_fab.fab.grasshopper.utilities import unload_modules 
unload_modules('tolerance_analysis')
from compas_fab.fab.geometry import Frame, Transformation
from compas.geometry.elements import Line
import rhinoscriptsyntax as rs
import Rhino.Geometry as rg
import Rhino
import scriptcontext as sc
import json
from System import Guid

#Generate Text Dot with the Beams order
if generate_TextDot==True:
    generated_textDot_list=[]
    for edge in edges:
        sc.doc = Rhino.RhinoDoc.ActiveDoc 
        generated_textDot_list.append(rs.AddTextDot("0",rs.CurveMidPoint(edge)))
        sc.doc = ghdoc
    data=[]
    for guid in generated_textDot_list:
        data.append(str(guid))
    with open(r"C:/Users/gandiaa/Documents/projects/tolerance_analysis/data170521.json", 'w') as filename:
        json.dump(data, filename)
with open(r"C:/Users/gandiaa/Documents/projects/tolerance_analysis/data170521.json", 'r') as filename:
    restored_data = json.load(filename)

#Filter DotText objects
objs = restored_data
textDotIDs=[]
for objsID in objs:
    if rs.IsTextDot(Guid.Parse(objsID))==True:
        textDotIDs.append(Guid.Parse(objsID))

#Get text from DotText
weights_list=[]
textDot_list=[]
for objsID in objs:
    weights_list.append(int(Rhino.RhinoDoc.ActiveDoc.Objects.Find(Guid.Parse(objsID)).Geometry.Text))
    textDot_list.append(Rhino.RhinoDoc.ActiveDoc.Objects.Find(Guid.Parse(objsID)).Geometry)

#Prepare edges and joints for Network
joint_list=[]
for joint in joints:
    joint_list.append(Line(joint.PointAtStart,joint.PointAtEnd))
    
edge_list=[]
for edge in edges:
    #edge_list.append(Line(edge.PointAt(0),edge.PointAt(edge.GetLength())))
    edge_list.append(Line(edge.PointAtStart,edge.PointAtEnd))

#Build Network
tolerance_network=ToleranceNetwork(joint_list, edge_list, beams, weights_list)

edge_joint=[]
for u,v,attr in tolerance_network.edges(data=True):
    if attr['edge_type']=='joint':
        coords_1 = tolerance_network.vertex_coordinates(u)
        coords_2 = tolerance_network.vertex_coordinates(v)
        pt_1 = rg.Point3d(coords_1[0],coords_1[1],coords_1[2])
        pt_2 = rg.Point3d(coords_2[0],coords_2[1],coords_2[2])
        edge_joint.append(rg.Line(pt_1,pt_2))

edge_beam=[]
for u,v,attr in tolerance_network.edges(data=True):
    if attr['edge_type']=='member':
        coords_1 = tolerance_network.vertex_coordinates(u)
        coords_2 = tolerance_network.vertex_coordinates(v)
        pt_1 = rg.Point3d(coords_1[0],coords_1[1],coords_1[2])
        pt_2 = rg.Point3d(coords_2[0],coords_2[1],coords_2[2])
        edge_beam.append(rg.Line(pt_1,pt_2))

#Iterate connectivity list according to slider and display edge selected and connected edges
connectivity_edges=[]
for u,v,attr in tolerance_network.edges(data=True):
    if attr['edge_type']=='member':
        temp_connectivity_edges=[]
        for connected_edge in attr['member_edge_nbrs']: 
            coords_1=tolerance_network.vertex_coordinates(connected_edge[0])
            coords_2=tolerance_network.vertex_coordinates(connected_edge[1])
            pt_1 = rg.Point3d(coords_1[0],coords_1[1],coords_1[2])
            pt_2 = rg.Point3d(coords_2[0],coords_2[1],coords_2[2])
            temp_connectivity_edges.append(rg.Line(pt_1,pt_2))
        coords_1=tolerance_network.vertex_coordinates(u)
        coords_2=tolerance_network.vertex_coordinates(v)
        pt_1 = rg.Point3d(coords_1[0],coords_1[1],coords_1[2])
        pt_2 = rg.Point3d(coords_2[0],coords_2[1],coords_2[2])
        temp_connectivity_edges.append(rg.Line(pt_1,pt_2))
        connectivity_edges.append(temp_connectivity_edges)
edge_connected=connectivity_edges[selected_beam]

#Display vertex as beam (beam_vertex) and edges as connections (topology_edges)
beam_vertex_list=[]
topology_edges=[]
for u, attr in tolerance_network.assembly_sequence_network.vertices(data=True):
    pt_1 = rg.Point3d(attr['x'],attr['y'],attr['z'])
    beam_vertex_list.append(pt_1)
    for vertex in tolerance_network.assembly_sequence_network.adjacency_dictionary[u]:
        coords_2= tolerance_network.assembly_sequence_network.vertex_coordinates(vertex)
        pt_2 = rg.Point3d(coords_2[0],coords_2[1],coords_2[2])
        topology_edges.append(rg.Line(pt_1,pt_2))

#Iterate according to MST order
beam_mesh=[]
vertices_list=[]
for u,v,attr in tolerance_network.edges(data=True):
    if attr['edge_type']=='member':
        beam_mesh.append(attr['beam'].mesh)

assembly_sequence=[]
for i in range(selected_beam+1):
    mst_index=tolerance_network.result[i]
    assembly_sequence.append(beam_mesh[int(mst_index)])
# ---------- end python_6 ----------
generate_beam_axes = PythonScript(beams=cull_error_beams)  # -> out, a, b; inputs beams: list
# ---------- generate_beam_axes: Python ----------
from compas_fab.fab.geometry import Frame, Transformation
from compas.geometry.elements import Line
from compas.geometry.elements import Point
from compas.geometry.elements import Vector
import rhinoscriptsyntax as rs
import Rhino.Geometry as rg
import scriptcontext as sc

beam_axes=[]
beams_meshes=[]
for beam in beams:
    pt1=beam.axis_end_points[0]
    pt2=beam.axis_end_points[1]
    axis_vec_1=beam.axis_vec*(100)
    axis_vec_2=beam.axis_vec*(-100)
    new_pt1=rg.Vector3d.Add(rg.Vector3d(pt1),axis_vec_1) 
    new_pt2=rg.Vector3d.Add(rg.Vector3d(pt2),axis_vec_2) 
    beam_axis=rg.Line(rg.Point3d(new_pt1),rg.Point3d(new_pt2))
    beam_axes.append(beam_axis)
    beams_meshes.append(beam.mesh)
a=beam_axes
b=beams_meshes
# ---------- end generate_beam_axes ----------

# ---- group: Edges
material = CreateMaterial(Diffuse=RGB(249, 219, 145), Specular=RGB(255, 255, 255), Emission=RGB(0, 0, 0), Transparency=0, Shine=0)
# Structure Topology
edge_lines = Curve(python_2.Edges)
preview = CustomPreview(Geometry=edge_lines, Shader=material)

# ----
mesh = Mesh(python_6.assembly_sequence)

# ---- group: Vertices
pt_3 = Point(python_2.Vertices)
points = PointList(Points=pt_3, Size=Slider(100, range=0..200))

# ----
# Structure Beams
brep_2 = Brep(python_5.beams_srf)
material_2 = CreateMaterial(Diffuse=RGB(249, 219, 145), Specular=RGB(255, 255, 255), Emission=RGB(0, 0, 0), Transparency=0, Shine=0)
preview_2 = CustomPreview(Geometry=brep_2, Shader=material_2)

# ----
# Example: concatenation of matrices
# based on list of frames and sequence
list_2 = ValueList({"0", "1", "2", "3", "4", "5", "6", "7", "8", "9"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}, selected="15")
list_3 = ValueList({"0", "1", "2", "3", "4", "5", "6", "7", "8", "9"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}, selected="0")
list_4 = ValueList({"0", "1", "2", "3", "4", "5", "6", "7", "8", "9"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}, selected="46")
# Example: urdf
python_7 = PythonScript()  # -> out, a
# ---------- python_7: Python ----------
"""
from compas.geometry import Vector
from compas.geometry import transform_vectors
from compas.geometry import Transformation
from compas.geometry import Rotation
from compas.geometry import Translation
from compas.geometry import Line
from compas.geometry import Frame
"""

from compas_fab.fab.geometry import Frame, Transformation, Rotation,Translation
from compas.geometry.elements import Line,Vector
def transform_vectors(vectors, T):
    return dehomogenize(multiply_matrices(homogenize(vectors, w=0.0), transpose_matrix(T)))

class Origin(Frame):
    """
    """
    def __init__(self, point, xaxis, yaxis):
        super(Origin, self).__init__(point, xaxis, yaxis)
        self.init = Frame(point, xaxis, yaxis)

    def reset_transform(self):
        cp = self.init.copy()
        self.point = cp.point
        self.xaxis = cp.xaxis
        self.yaxis = cp.yaxis


class Axis(Vector):
    """
    """
    def __init__(self, x, y, z):
        super(Axis, self).__init__(x, y, z)
        self.init = Vector(x, y, z)

    def reset_transform(self):
        cp = self.init.copy()
        self.x = cp.x
        self.y = cp.y
        self.z = cp.z


class Joint(object):
    """
    """
    REVOLUTE = 0
    CONTINUOUS = 1 
    PRISMATIC = 2
    FIXED = 3
    FLOATING = 4 
    PLANAR = 5

    def __init__(self, name, type, parent, child, origin=None, axis=None):
        self.name = name
        self.type = type
        self.origin = origin
        self.axis = axis
        self.parent = parent
        self.child = child
        self.parent_link = None
        self.child_link = None
        self.position = 0  # the position of the joint

    @property
    def current_transformation(self):
        if self.origin:
            return Transformation.from_frame(self.origin)
        else:
            return Transformation()

    @property
    def init_transformation(self):
        if self.origin:
            return Transformation.from_frame(self.origin.init)
        else:
            return Transformation()

    def reset_transform(self):
        if self.origin:
            self.origin.reset_transform()
        if self.axis:
            self.axis.reset_transform()

    def transform(self, transformation):
        if self.origin:
            self.origin.transform(transformation)
        if self.axis:
            self.axis.transform(transformation)
    
    def calculate_transformation(self, position):
        """Calculates the transformation of the joint based on the position and
        its type.
        """
        if self.type in [Joint.REVOLUTE, Joint.CONTINUOUS]:
            return Rotation.from_axis_and_angle(self.axis, position, self.origin.point)
        elif self.type == Joint.PRISMATIC:
            return Translation(self.axis * position)
        elif self.type == Joint.FIXED:
            return Transformation() # identity matrix
        elif self.type == Joint.FLOATING:
            raise NotImplementedError
        else: # == Joint.PLANAR
            raise NotImplementedError

    def calculate_reset_transformation(self):
        return self.init_transformation * self.current_transformation.inverse()
    
    def is_configurable(self):
        return self.type != Joint.FIXED



class Link(object):
    """
    """

    def __init__(self, name, geometry=None):
        self.name = name
        self.geometry = geometry
        self.joints = []
        self.parent_joint = None

    def update(self, joint_state, parent_transformation, reset_transformation):
        """Recursive function to apply the transformations given by the joint
            state.
        Joint_states are given absolute, so it is necessary to reset the current
        transformation.
        Args:
            joint_state (dict): A dict with the joint names as keys and positions 
                as values in radians and mm (depending on the joint type)
            parent_transformation (:class:`Transformation`): The transfomation 
                of the parent joint
            reset_transformation (:class:`Transformation`): The transfomation 
                to reset the current transformation of the link's geometry.
        """
        relative_transformation = parent_transformation * reset_transformation

        if self.geometry:
            self.geometry.transform(relative_transformation)
        
        for joint in self.joints:
            # 1. Get reset transformation
            reset_transformation = joint.calculate_reset_transformation()
            # 2. Reset
            joint.reset_transform()
            #joint.transform(reset_transformation) # why does this not work properly....

            # 3. Calculate transformation
            if joint.name in joint_state.keys():
                position = joint_state[joint.name]
                transformation = joint.calculate_transformation(position)
                transformation = parent_transformation * transformation
                joint.position = position
            else:
                transformation = parent_transformation

            # 4. Apply on joint
            joint.transform(transformation)
            # 4. Apply function to all children
            joint.child_link.update(joint_state, transformation, reset_transformation)


class Model(object):

    def __init__(self):
        self.joints = []
        self.links = []
        self.root = None

    def add_link(self, link):
        self.links.append(link)

    def add_joint(self, joint):
        self.joints.append(joint)

    def get_link_by_name(self, name):
        for link in self.links:
            if link.name == name:
                return link
        return None

    def get_joint_by_name(self, name):
        for joint in self.joints:
            if joint.name == name:
                return joint
        return None

    def build_tree(self):
        for joint in self.joints:
            parent_link = self.get_link_by_name(joint.parent)
            joint.parent_link = parent_link
            parent_link.joints.append(joint)
            child_link = self.get_link_by_name(joint.child)
            joint.child_link = child_link
            child_link.parent_joint = joint
        # search root link
        for link in self.links:
            if not link.parent_joint:
                self.root = link
                break

    def update(self, joint_state):
        # joint states are absolute
        self.root.update(joint_state, Transformation(), Transformation())

    def get_geometry(self):
        geometry = []
        for link in self.links:
            if link.geometry:
                geometry.append(link.geometry)
        return geometry



if __name__ == "__main__":
    
    model = Model()
    base_link = Link("base_link")
    joint0 = Joint("joint0", Joint.REVOLUTE, "base_link", "link0", origin=Origin.worldXY(), axis=Axis(0,0,1))
    link0 = Link("link0", Line([0,0,0], [0,0,100]))
    joint1 = Joint("joint1", Joint.REVOLUTE, "link0", "link1", origin=Origin([0,0,100],[1,0,0],[0,1,0]), axis=Axis(1,0,0))
    link1 = Link("link1", Line([0,0,100], [200,0,100]))
    joint2 = Joint("joint2", Joint.PRISMATIC, "link1", "link2", origin=Origin([200,0,100],[1,0,0],[0,1,0]), axis=Axis(0,0,1))
    link2 = Link("link2", Line([200,0,100], [200,0,300]))
    joint3 = Joint("joint3", Joint.REVOLUTE, "link2", "link3", origin=Origin([200,0,300],[1,0,0],[0,1,0]), axis=Axis(1,0,0))
    link3 = Link("link3", Line([200,0,300], [0,0,300]))

    model.add_link(base_link)
    model.add_link(link0)
    model.add_link(link1)
    model.add_link(link2)
    model.add_link(link3)
    model.add_joint(joint0)
    model.add_joint(joint1)
    model.add_joint(joint2)
    model.add_joint(joint3)
    model.build_tree() # important!

    import math
    import Rhino.Geometry as rg
    
    a0, a1, a2, a3 = 0.104, -0.506, 41.0, 0.436
    joint_positions = [a0, a1, a2, a3]
    joint_names = ["joint0", "joint1", "joint2", "joint3"]
    
    joint_state = {}
    for k,v in zip(joint_names, joint_positions):
        joint_state[k] = v
    
    model.update(joint_state)
    lines = model.get_geometry()
    
    rglines = []
    for line in lines:
        start, end = rg.Point3d(*list(line.start)), rg.Point3d(*list(line.end))
        rglines.append(rg.Line(start, end))
# ---------- end python_7 ----------
list_5 = ValueList({"0", "1", "2", "3", "4", "5", "6", "7", "8", "9"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}, selected="0")
item = ListItem(List=cull_error_beams, Index=[list_2, list_3, list_4], Wrap=True)
cnc_saw = PythonScript(
    update=Button(),
    beamData=python_2.Beams,
    pathWriteSawCode="C://Users//mhelmrei//Desktop//KTI_Holzbau//08_CNC_Code//",
    writeFiles=Button(),
    AssignAssemblySequence=Toggle(False))  # -> out, blade, rectangle, points, breps, circlePlane2, angleMeasureLineStartPlaneZsezi, MillingToolPreviewStartEnd, preview; inputs beamData: list, writeFiles: Boolean, AssignAssemblySequence: Boolean
# ---------- cnc_saw: Python ----------
import rhinoscriptsyntax as rs
from spatial_timber_assemblies.useful.import_or_reload import *

from time import gmtime, strftime

date = strftime("17%m%d_", gmtime())


if update:
	pass

reload_lib("timber_fabrication.cnc_saw")
reload_lib("timber_fabrication.useful")

import timber_fabrication.cnc_saw as tf
import timber_fabrication.useful as us

#print tf.__file__

if AssignAssemblySequence == True:
	response = rs.MessageBox('''Redefine Assembly Order?''', 4)
else:
	response = 0
	
preview = tf.Unit(beamData, AssignAssemblySequence,response)

if writeFiles == True:
	for i, member in enumerate(preview.allMembers):
		###WRITE PRODUCTION DATA
		path_header = ("{0}header.txt").format(pathWriteSawCode)
		file = open(path_header)
		header = file.readlines()
		file.close() 

		path_headerBeam = ("{0}header_beam.txt").format(pathWriteSawCode)
		file2 = open(path_headerBeam)
		headerBeam = file2.readlines()
		file2.close() 

		if i < 10:
			counter = ("00{0}").format(str(i))
		elif 10 <= i < 100:
			counter = ("0{0}").format(str(i))
		else:
			counter = ("{0}").format(str(i))

		path = ("{0}{1}SAWCODE_MEMBER_{2}.atg").format(pathWriteSawCode, date, counter)
		newFile = open(path,"w")
		newFile.writelines(header)
		newFile.write(member.sawCommand)
	
		newFile.close()
# ---------- end cnc_saw ----------
propagation_example = PythonScript(beams=item, frame_n=list_5)  # -> out, display_frame; inputs beams: list
# ---------- propagation_example: Python ----------
from tolerance_analysis import ToleranceNetwork
from compas_fab.fab.grasshopper.utilities import unload_modules 
unload_modules('tolerance_analysis')
from compas_fab.fab.geometry import Frame, Transformation, Translation
from compas.geometry.elements import Line
from compas_fab.fab.grasshopper.utilities.drawing import xdraw_frame
import rhinoscriptsyntax as rs
import Rhino.Geometry as rg
import Rhino
import scriptcontext as sc

#Extra functions for transform in own frame
def translate_frame_own_x(transformation, distance):
    x_transform = [[1, 0, 0, (transformation[0, 0] * distance)],
                   [0, 1, 0, (transformation[1, 0] * distance)],
                   [0, 0, 1, (transformation[2, 0] * distance)],
                   [0, 0, 0, 1]]
    return Translation.from_matrix(x_transform)

def translate_frame_own_y(transformation,  distance):
    y_transform = [[1, 0, 0, (transformation[0, 1]*distance)],
                   [0, 1, 0, (transformation[1, 1]*distance)],
                   [0, 0, 1, (transformation[2, 1]*distance)],
                   [0, 0, 0, 1]]
    return Translation.from_matrix(y_transform)

def translate_frame_own_z(transformation,  distance):
    z_transform = [[1, 0, 0, (transformation[0, 2]*distance)],
                   [0, 1, 0, (transformation[1, 2]*distance)],
                   [0, 0, 1, (transformation[2, 2]*distance)],
                   [0, 0, 0, 0]]
    return Translation.from_matrix(z_transform)

#Build rhino and compas plane lists

rhino_planes=[]
compas_frames=[]
for i in range(len(beams)):
    rhino_plane_A=beams[i].end_planes[0]
    rhino_plane_B=beams[i].end_planes[1]
    rhino_planes.append(rhino_plane_A)
    rhino_planes.append(rhino_plane_B)
    compas_frame_A=Frame(rhino_plane_A[0],rhino_plane_A[1],rhino_plane_A[2])
    compas_frame_B=Frame(rhino_plane_B[0],rhino_plane_B[1],rhino_plane_B[2])
    compas_frames.append(compas_frame_A)
    compas_frames.append(compas_frame_B)

#Re-order planes (needs to be improved)
for i in range(len(rhino_planes)):
    #check first vertex plane
    if i%2==0:
        origin=rhino_planes[i].Origin
        next_origin=rhino_planes[i-1].Origin
        #if it is not v1 alter list order
        if origin.DistanceTo(next_origin)>100 and i!=0:
            temp_plane=rhino_planes[i]
            temp_frame=compas_frames[i]
            rhino_planes.pop(i)
            rhino_planes.append(temp_plane)
            compas_frames.pop(i)
            compas_frames.append(temp_frame)
"""
#Example of translating frame on its own frame
#Get transformation to frame
origin_V0=Transformation.from_frame(compas_frames[0])
#Get transformation to shifted frame
tolerance=translate_frame_own_z(origin_V0, 100)
#Multiply them
M1=tolerance*origin_V0
#Display new frame
a=xdraw_frame(Frame.from_transformation(M1))
"""
#Build relations(transformations) for ordered frames (Hard coded)
def add_tolerance(frame):
    #Example of translating frame on its own frame
    #Get transformation to frame
    origin_V0=Transformation.from_frame(frame)
    #Get transformation to shifted frame
    tolerance=translate_frame_own_z(origin_V0, 100)
    #Multiply them
    M1=tolerance*origin_V0
    return Frame.from_transformation(M1)

transformations=[]
#Transformation 0,0,0 to V0
origin_V0=Transformation.from_frame(compas_frames[0])
transformations.append(origin_V0)
#Transformation to V1
#V0-V1*origin
V0_V1=Transformation.from_frame_to_frame(compas_frames[0], compas_frames[1])
tr_V1=V0_V1*origin_V0
transformations.append(tr_V1)
#joint transformation with tolerance
V1_V2_tlr=Transformation.from_frame_to_frame(compas_frames[1], add_tolerance(compas_frames[2]))
#joint transformation no tolerance
V1_V2=Transformation.from_frame_to_frame(compas_frames[1], compas_frames[2])
tr_V2=V1_V2*tr_V1
tr_V2_tlr=V1_V2_tlr*tr_V1
transformations.append(tr_V2_tlr)
#Transformation to V3
#V2-V3*V1-V2*V0-V1*origin)
V2_V3=Transformation.from_frame_to_frame(compas_frames[1], compas_frames[3])
tr_V3=V2_V3*tr_V2_tlr

a=V0_V1*origin_V0
b=V1_V2_tlr.inverse()*a
c=V2_V3*b

transformations.append(tr_V3)
#Transformation to V4
#V3-V4*V2-V3*V1-V2*V0-V1*origin)
V3_V4=Transformation.from_frame_to_frame(compas_frames[3], compas_frames[4])
tr_V4=V3_V4*tr_V3
transformations.append(tr_V4)
#Transformation to V5
#V4-V5*V3-V4*V2-V3*V1-V2*V0-V1*origin)
V4_V5=Transformation.from_frame_to_frame(compas_frames[4], compas_frames[5])
tr_V5=V4_V5*tr_V4
transformations.append(tr_V5)

#Display frames
#transformations=concatenate_frames(compas_frames)
transform=transformations[int(frame_n)]
display_frame=xdraw_frame(Frame.from_transformation(transform))




#Build relations(transformations) for ordered frames (autimated)
def concatenate_frames(frames):
    #Skip 2 first frames
    transformations=[]
    #Transformation 0,0,0 to V0
    origin_V0=Transformation.from_frame(frames[0])
    transformations.append(origin_V0)
    #Transformation to V1
    #V0-V1*origin
    V0_V1=Transformation.from_frame_to_frame(frames[0],frames[1])
    tr_V1=V0_V1*origin_V0
    transformations.append(tr_V1)
    for i in range(1,len(frames),1):
        if i!=int(len(frames)-1):
            #generate beam transformation
            if i%2!=0:
                print "a",i,i+1
                Vi_Vii=Transformation.from_frame_to_frame(frames[i], frames[i+1])
                tr_Vii=Vi_Vii*transformations[i]
                transformations.append(tr_Vii)
            #generate joint transformation
            else:
                print "b",i,i+1
                Vi_Vii=Transformation.from_frame_to_frame(frames[i], frames[i+1])
                tr_Vii=Vi_Vii*transformations[i]
                transformations.append(tr_Vii)
    return transformations
"""
#call automated function
transformations=concatenate_frames(compas_frames)
#display frames
transform=transformations[int(frame_n)]

display_frame=xdraw_frame(Frame.from_transformation(transform))
"""
# ---------- end propagation_example ----------
panel_2 = Panel(cnc_saw.out)
gripperrob11 = Mesh(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)
gripperrob12 = Mesh(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)
merge = Merge(Data1=gripperrob11, Data2=gripperrob12)
placeposition = ValueList({"0", "1", "2", "3", "4"}, selected="2")
gripper = ValueList({"0", "1"}, selected="1")
gripper_2 = ListItem(List=merge, Index=gripper, Wrap=True)

# ---- group: BEAM
currentbeam = ValueList({"0", "1", "2", "3", "4", "5", "6", "7", "8", "9"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}, selected="41")

# ---- group: CLASS
python_8 = PythonScript(preview=cnc_saw.preview, counter=currentbeam)  # -> out, ListGripPlanePickAtSaw, ListGripPlaneCutStartAtSaw, ListGripPlaneCutEndAtSaw, ListMeshAtTable, ListMeshAtSaw, ListSawData, ListStartPlanesAtTable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; inputs counter: Int32
# ---------- python_8: Python ----------
ListGripPlaneOpti = preview.ListGripPlaneOpti
ListGripPlaneTable = preview.ListGripPlaneAtTable
ListGripPlanePickAtSaw = preview.ListGripPlanePickAtSaw
ListGripPlaneCutStartAtSaw = preview.ListGripPlaneCutStartAtSaw
ListGripPlaneCutEndAtSaw = preview.ListGripPlaneCutEndAtSaw

ListMeshAtTable = preview.ListMeshAtTable

ListMeshAtSaw = preview.ListMeshAtSaw
ListSawData = preview.ListSawData

ListStartPlanesAtTable = preview.ListStartPlanesAtTable
ListEndPlanesAtTable = preview.ListEndPlanesAtTable
ListStartPlanesAtSaw = preview.ListStartPlanesAtSaw
ListEndPlanesAtSaw = preview.ListEndPlanesAtSaw
ListStartPlanes = preview.ListStartPlanes
ListEndPlanes = preview.ListEndPlanes

ListDrillStartPlane_1_Side = preview.ListDrillStartPlane_1_Side
ListDrillStartPlane_2_Side = preview.ListDrillStartPlane_2_Side
ListDrillStartPlane_1_Cut = preview.ListDrillStartPlane_1_Cut
ListDrillStartPlane_2_Cut = preview.ListDrillStartPlane_2_Cut
ListDrillBoolean = preview.ListDrillBoolean

ListDrillEndPlane_1_Side = preview.ListDrillEndPlane_1_Side
ListDrillEndPlane_2_Side = preview.ListDrillEndPlane_2_Side
ListDrillEndPlane_1_Cut = preview.ListDrillEndPlane_1_Cut
ListDrillEndPlane_2_Cut = preview.ListDrillEndPlane_2_Cut

ListDrillStartPlaneAtSaw_1_Side = preview.ListDrillStartPlaneAtSaw_1_Side
ListDrillStartPlaneAtSaw_2_Side = preview.ListDrillStartPlaneAtSaw_2_Side
ListDrillStartPlaneAtSaw_1_Cut = preview.ListDrillStartPlaneAtSaw_1_Cut
ListDrillStartPlaneAtSaw_2_Cut = preview.ListDrillStartPlaneAtSaw_2_Cut

ListDrillEndPlaneAtSaw_1_Side = preview.ListDrillEndPlaneAtSaw_1_Side
ListDrillEndPlaneAtSaw_2_Side = preview.ListDrillEndPlaneAtSaw_2_Side
ListDrillEndPlaneAtSaw_1_Cut = preview.ListDrillEndPlaneAtSaw_1_Cut
ListDrillEndPlaneAtSaw_2_Cut = preview.ListDrillEndPlaneAtSaw_2_Cut
ListWall = preview.ListWall
ListType = preview.ListType
ListSawDATA = preview.ListSawDATA

ListGripPlanePlace = preview.ListGripPlanePlace
ListReGripSaw = preview.ListReGripSaw
ListCrossSection = preview.ListCrossSection
ListCrossSectionCheck = preview.ListCrossSectionCheck
ListDisplayErrorsHeight = preview.ListDisplayErrorsHeight
ListDisplayErrorsAngle = preview.ListDisplayErrorsAngle
ListScrewPreview = preview.ListScrewPreview[counter]
ListIsCorner = preview.ListIsCorner
ListClearIn_1 = preview.ListClearIn_1
ListClearIn_2 = preview.ListClearIn_2
ListClearOut_3 = preview.ListClearOut_3
ListClearOut_4 = preview.ListClearOut_4
ListID = preview.ListID
ListGripperMessage = preview.GripperMessage
ListTargetROBOT = preview.ListROB_Active
ListClearIn_1_Mesh = preview.ListClearIn_1_Mesh
# ---------- end python_8 ----------

# ----
python_9 = PythonScript(GripperROB11=gripper_2, GripperROB12=gripper_2, preview=cnc_saw.preview, counter=currentbeam, position=placeposition)  # -> out, previewGripper, previewGripperOrigin; inputs GripperROB11: Mesh, GripperROB12: Mesh, position: Int32
# ---------- python_9: Python ----------
import rhinoscriptsyntax as rs
import Rhino.Geometry as rg

planeGripPlace = [preview.ListClearIn_1[counter], preview.ListClearIn_2[counter], preview.ListGripPlanePlace[counter], preview.ListClearOut_3[counter], preview.ListClearOut_4[counter]][position]
planeGripSawPick = preview.ListGripPlanePickAtSaw[counter]
planeGripSawStart = preview.ListGripPlaneCutStartAtSaw[counter]
planeGripSawEnd = preview.ListGripPlaneCutEndAtSaw[counter]


planeGripPlaceOrigin = preview.GripperGeoOriginList[counter][0]
planeGripSawPickOrigin = preview.GripperGeoOriginList[counter][1]
planeGripSawStartOrigin = preview.GripperGeoOriginList[counter][2]
planeGripSawEndOrigin = preview.GripperGeoOriginList[counter][3]


def reorientPlaneMesh(subject,source,target):
	xform = rg.Transform.PlaneToPlane(source,target)
	if type(subject) == type(rg.Plane.WorldXY):
		new_subject = rg.Plane(subject.Origin,subject.XAxis,subject.YAxis)
		new_subject.Transform(xform)
	elif type(subject) is rg.Brep:
		new_subject = rg.Brep.DuplicateBrep(subject)
		rg.Brep.Transform(new_subject, xform)
	elif type(subject) is rg.Mesh:
		new_subject = rg.Mesh.DuplicateMesh(subject)
		rg.Mesh.Transform(new_subject, xform)
	elif type(subject) is rg.Point3d:
		new_subject = rg.Point3d(subject)
		new_subject.Transform(xform)
	elif type(subject) is rg.Surface:
		new_subject = rg.Surface(subject)
		new_subject.Transform(xform)
	return new_subject


if preview.ListROB_Active[counter] == "ROB_11":
	Gripper = GripperROB11
else:
	Gripper = GripperROB12

previewGripperPlace = reorientPlaneMesh(Gripper, rg.Plane.WorldXY, planeGripPlace)
previewGripperPick = reorientPlaneMesh(Gripper, rg.Plane.WorldXY, planeGripSawPick)
previewGripperStart = reorientPlaneMesh(Gripper, rg.Plane.WorldXY, planeGripSawStart)
previewGripperEnd = reorientPlaneMesh(Gripper, rg.Plane.WorldXY, planeGripSawEnd)

previewGripperPlaceOrigin = reorientPlaneMesh(Gripper, rg.Plane.WorldXY, planeGripPlaceOrigin)
previewGripperPickOrigin = reorientPlaneMesh(Gripper, rg.Plane.WorldXY, planeGripSawPickOrigin)
previewGripperStartOrigin = reorientPlaneMesh(Gripper, rg.Plane.WorldXY, planeGripSawStartOrigin)
previewGripperEndOrigin = reorientPlaneMesh(Gripper, rg.Plane.WorldXY, planeGripSawEndOrigin)




previewGripper = []
previewGripperOrigin = []

previewGripper.extend([previewGripperPlace, previewGripperPick, previewGripperStart, previewGripperEnd])
previewGripperOrigin.extend([previewGripperPlaceOrigin, previewGripperPickOrigin, previewGripperStartOrigin, previewGripperEndOrigin])
# ---------- end python_9 ----------
drillstartplaneatsaw_1_side = Plane(python_8.ListDrillStartPlaneAtSaw_1_Side)
drillstartplaneatsaw_2_side = Plane(python_8.ListDrillStartPlaneAtSaw_2_Side)
drillstartplaneatsaw_1_cut = Plane(python_8.ListDrillStartPlaneAtSaw_1_Cut)
drillstartplaneatsaw_2_cut = Plane(python_8.ListDrillStartPlaneAtSaw_2_Cut)
drillendplaneatsaw_1_side = Plane(python_8.ListDrillEndPlaneAtSaw_1_Side)
drillendplaneatsaw_2_side = Plane(python_8.ListDrillEndPlaneAtSaw_2_Side)
drillendplaneatsaw_1_cut = Plane(python_8.ListDrillEndPlaneAtSaw_1_Cut)
drillendplaneatsaw_2_cut = Plane(python_8.ListDrillEndPlaneAtSaw_2_Cut)
drillstartplane_1_side = Plane(python_8.ListDrillStartPlane_1_Side)
drillstartplane_2_side = Mesh(python_8.ListDrillStartPlane_2_Side)
drillstartplane_1_cut = Plane(python_8.ListDrillStartPlane_1_Cut)
drillstartplane_2_cut = Plane(python_8.ListDrillStartPlane_2_Cut)
drillendplane_1_side = Plane(python_8.ListDrillEndPlane_1_Side)
drillendplane_2_side = Mesh(python_8.ListDrillEndPlane_2_Side)
drillendplane_1_cut = Plane(python_8.ListDrillEndPlane_1_Cut)
drillendplane_2_cut = Plane(python_8.ListDrillEndPlane_2_Cut)
crosssectioncheck = Data(python_8.ListCrossSectionCheck)
crosssection = Data(python_8.ListCrossSection)
gripstartcut = Plane(python_8.ListGripPlaneCutStartAtSaw)
drillboolean = Data(python_8.ListDrillBoolean)
gripplaceall = Plane(python_8.ListGripPlanePlace)
meshclear1 = Mesh(python_8.ListClearIn_1_Mesh)
gripendcut = Plane(python_8.ListGripPlaneCutEndAtSaw)
meshtable = Mesh(python_8.ListMeshAtTable)
meshtable_2 = Mesh(python_8.ListDisplayErrorsAngle)
meshtable_3 = Mesh(python_8.ListDisplayErrorsHeight)
clearout_3 = Plane(python_8.ListClearOut_3)
clearout_4 = Plane(python_8.ListClearOut_4)
starttable = Plane(python_8.ListStartPlanesAtTable)
meshsaw = Mesh(python_8.ListMeshAtSaw)
endtable = Plane(python_8.ListEndPlanesAtTable)
clearin_1 = Plane(python_8.ListClearIn_1)
clearin_2 = Plane(python_8.ListClearIn_2)
startsaw = Plane(python_8.ListStartPlanesAtSaw)
sawdata = Data(python_8.ListSawDATA)
grippick = Plane(python_8.ListGripPlanePickAtSaw)
endsaw = Plane(python_8.ListEndPlanesAtSaw)
start = Plane(python_8.ListStartPlanes)
end = Plane(python_8.ListEndPlanes)
regrip = Data(python_8.ListReGripSaw)
wall = Data(python_8.ListWall)
type = Data(python_8.ListType)
data = Data(python_8.ListID)
data_2 = Data(python_8.ListTargetROBOT)
errorangle = CustomPreview(Geometry=meshtable_2, Shader=ColourSwatch(SwatchColor=RGB(255, 0, 0)))
errorheight = CustomPreview(Geometry=meshtable_3, Shader=ColourSwatch(SwatchColor=RGB(234, 255, 0)))
gripper_3 = CustomPreview(Geometry=python_9.previewGripper, Shader=ColourSwatch(SwatchColor=RGB(102, 127, 178)))
originalgripper = CustomPreview(Geometry=python_9.previewGripperOrigin, Shader=ColourSwatch(SwatchColor=RGB(255, 0, 0)))
grip = ListItem(List=python_8.ListGripPlaneOpti, Index=currentbeam, Wrap=True)
grip_2 = ListItem(List=grippick, Index=currentbeam, Wrap=True)
grip_3 = ListItem(List=gripstartcut, Index=currentbeam, Wrap=True)
grip_4 = ListItem(List=gripendcut, Index=currentbeam, Wrap=True)
grip_5 = ListItem(List=gripplaceall, Index=currentbeam, Wrap=True)
grip_6 = ListItem(List=clearin_1, Index=currentbeam, Wrap=True)
grip_7 = ListItem(List=clearin_2, Index=currentbeam, Wrap=True)
grip_8 = ListItem(List=clearout_3, Index=currentbeam, Wrap=True)
grip_9 = ListItem(List=clearout_4, Index=currentbeam, Wrap=True)
mesh_2 = ListItem(List=meshtable, Index=currentbeam, Wrap=True)
mesh_3 = ListItem(List=meshsaw, Index=currentbeam, Wrap=True)
mesh_4 = SplitList(List=meshtable, Index=currentbeam)  # -> ListA, ListB
sawcode = ListItem(List=python_8.ListSawData, Index=currentbeam, Wrap=True)
regrip_2 = ListItem(List=data, Index=currentbeam, Wrap=True)
regrip_3 = ListItem(List=regrip, Index=currentbeam, Wrap=True)
wall_2 = ListItem(List=wall, Index=currentbeam, Wrap=True)
drillbool = ListItem(List=drillboolean, Index=currentbeam, Wrap=True)
type_2 = ListItem(List=type, Index=currentbeam, Wrap=True)
saw_data = ListItem(List=sawdata, Index=currentbeam, Wrap=True)
data_3 = ListItem(List=crosssection, Index=currentbeam, Wrap=True)
data_4 = ListItem(List=crosssectioncheck, Index=currentbeam, Wrap=True)
data_5 = ListItem(List=python_8.ListIsCorner, Index=currentbeam, Wrap=True)
data_6 = ListItem(List=python_8.ListGripperMessage, Index=currentbeam, Wrap=True)
data_7 = ListItem(List=data_2, Index=currentbeam, Wrap=True)
mesh_5 = ListItem(List=meshclear1, Index=currentbeam, Wrap=True)
panel_3 = Panel(sawcode)
panel_4 = Panel(data_4)
panel_5 = Panel(data_5)
panel_6 = Panel(data_6)
clearout_3all = Plane(clearout_3)
clearout_4all = Plane(clearout_4)
meshtableall = Mesh(mesh_4.ListA)
collision = CustomPreview(Geometry=meshtableall, Shader=ColourSwatch(SwatchColor=RGB(186, 186, 186)))
gripplaceall_2 = Plane(gripplaceall)
clearin_1all = Plane(clearin_1)
clearin_2all = Plane(clearin_2)
meshclear1_2 = Mesh(mesh_5)
clearout_3_2 = Plane(grip_8)
clearout_4_2 = Plane(grip_9)
meshtable_4 = Mesh(mesh_2)
gripplace = Plane(grip_5)
meshsaw_2 = Mesh(mesh_3)
gripstart = Plane(grip_3)
clearin_1_2 = Plane(grip_6)
clearin_2_2 = Plane(grip_7)
gripopti = Plane(grip)
grippick_2 = Plane(grip_2)
gripend = Plane(grip_4)
panel_7 = Panel(data_3)
panel_8 = Panel(type_2)
panel_9 = Panel(saw_data)
panel_10 = Panel(data_7)

# ---- group: CUT
cut = ListItem(List=starttable, Index=currentbeam, Wrap=True)
cut_2 = ListItem(List=endtable, Index=currentbeam, Wrap=True)
cut_3 = ListItem(List=start, Index=currentbeam, Wrap=True)
cut_4 = ListItem(List=end, Index=currentbeam, Wrap=True)
starttable_2 = Plane(cut)
start_2 = Plane(cut_3)
end_2 = Plane(cut_4)

# ----
cut_5 = ListItem(List=startsaw, Index=currentbeam, Wrap=True)
cut_6 = ListItem(List=endsaw, Index=currentbeam, Wrap=True)
panel_11 = Panel(regrip_2)
panel_12 = Panel(regrip_3)
panel_13 = Panel(wall_2)
panel_14 = Panel(drillbool)
endtable_2 = Plane(cut_2)
startsaw_2 = Plane(cut_5)
endsaw_2 = Plane(cut_6)
pipe = Pipe(Curve=python_8.ListScrewPreview, Radius=4, Caps=1)

# ---- group: DRILL
drill = ListItem(List=drillendplane_1_side, Index=currentbeam, Wrap=True)
drill_2 = ListItem(List=drillendplane_2_side, Index=currentbeam, Wrap=True)
drill_3 = ListItem(List=drillendplane_1_cut, Index=currentbeam, Wrap=True)
drill_4 = ListItem(List=drillendplane_2_cut, Index=currentbeam, Wrap=True)
drill_5 = ListItem(List=drillstartplaneatsaw_1_side, Index=currentbeam, Wrap=True)
drill_6 = ListItem(List=drillstartplaneatsaw_2_side, Index=currentbeam, Wrap=True)
drill_7 = ListItem(List=drillstartplaneatsaw_1_cut, Index=currentbeam, Wrap=True)
drill_8 = ListItem(List=drillstartplaneatsaw_2_cut, Index=currentbeam, Wrap=True)
drill_9 = ListItem(List=drillstartplane_1_side, Index=currentbeam, Wrap=True)
drill_10 = ListItem(List=drillstartplane_2_side, Index=currentbeam, Wrap=True)
drill_11 = ListItem(List=drillstartplane_1_cut, Index=currentbeam, Wrap=True)
drill_12 = ListItem(List=drillstartplane_2_cut, Index=currentbeam, Wrap=True)
drill_13 = ListItem(List=drillendplaneatsaw_1_side, Index=currentbeam, Wrap=True)
drill_14 = ListItem(List=drillendplaneatsaw_2_side, Index=currentbeam, Wrap=True)
drill_15 = ListItem(List=drillendplaneatsaw_1_cut, Index=currentbeam, Wrap=True)
drill_16 = ListItem(List=drillendplaneatsaw_2_cut, Index=currentbeam, Wrap=True)
drillstartplaneatsaw_1_side_2 = Plane(drill_5)
drillstartplaneatsaw_1_cut_2 = Plane(drill_7)
drillstartplaneatsaw_2_cut_2 = Plane(drill_8)
drillendplaneatsaw_1_side_2 = Plane(drill_13)
drillendplaneatsaw_1_cut_2 = Plane(drill_15)
drillendplaneatsaw_2_cut_2 = Plane(drill_16)
drillstartplane_1_side_2 = Plane(drill_9)
drillstartplane_2_side_2 = Mesh(drill_10)
drillstartplane_1_cut_2 = Plane(drill_11)
drillstartplane_2_cut_2 = Plane(drill_12)
drillendplane_1_side_2 = Plane(drill)
drillendplane_2_side_2 = Mesh(drill_2)
drillendplane_1_cut_2 = Plane(drill_3)
drillendplane_2_cut_2 = Plane(drill_4)

# ----
drillstartplaneatsaw_2_side_2 = Plane(drill_6)
drillendplaneatsaw_2_side_2 = Plane(drill_14)
error = CustomPreview(Geometry=pipe, Shader=ColourSwatch(SwatchColor=RGB(255, 0, 0)))
