# Grasshopper definition 180903_201_Mockup2Update_AG.ghx (Grasshopper 0.9.76)
# plug-ins: Python Interpreter

brep = Brep([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])
python = PythonScript(beams_geo=brep)  # -> out, beams, beam_meshes; inputs beams_geo: list of Brep
# ---------- python: Python ----------
from tolerance_analysis import beam
from compas_fab.fab.grasshopper.utilities import unload_modules 
unload_modules('tolerance_analysis')
unload_modules('spatial_timber_assemblies')
import rhinoscriptsyntax as rs
import Rhino.Geometry as rg
import scriptcontext as sc
tolerance = sc.doc.ModelAbsoluteTolerance

beams=[]
beam_meshes=[]
for i in range(len(beams_geo)):
    pt0=beams_geo[i].Vertices[0].Location
    pt1=beams_geo[i].Vertices[1].Location
    pt2=beams_geo[i].Vertices[2].Location
    pt3=beams_geo[i].Vertices[3].Location
    mid_pt1=rg.Line(pt0,pt2).PointAt(0.5)
    pt4=beams_geo[i].Vertices[4].Location
    pt5=beams_geo[i].Vertices[5].Location
    pt6=beams_geo[i].Vertices[6].Location
    pt7=beams_geo[i].Vertices[7].Location
    mid_pt2=rg.Line(pt4,pt6).PointAt(0.5)
    axis_vec=rg.Vector3d.Subtract(rg.Vector3d(mid_pt1),rg.Vector3d(mid_pt2))
    pl1_pt1=rg.Line(pt0,pt1).PointAt(0.5)
    pl1_pt2=rg.Line(pt0,pt3).PointAt(0.5)
    pl1_vec1=rg.Vector3d.Subtract(rg.Vector3d(mid_pt1),rg.Vector3d(pl1_pt1))
    pl1_vec2=rg.Vector3d.Subtract(rg.Vector3d(mid_pt1),rg.Vector3d(pl1_pt2))
    pl2_pt1=rg.Line(pt4,pt5).PointAt(0.5)
    pl2_pt2=rg.Line(pt4,pt7).PointAt(0.5)
    pl2_vec1=rg.Vector3d.Subtract(rg.Vector3d(mid_pt2),rg.Vector3d(pl2_pt1))
    pl2_vec2=rg.Vector3d.Subtract(rg.Vector3d(mid_pt2),rg.Vector3d(pl2_pt2))
    pl1=rg.Plane(mid_pt1,pl1_vec1,pl1_vec2)
    pl2=rg.Plane(mid_pt2,pl2_vec1,pl2_vec2)
    beam_mesh=rg.Mesh()
    for mesh in (rg.Mesh.CreateFromBrep(beams_geo[i])):
        beam_mesh.Append(mesh)
    beam_object=beam.Beam({"init_end_pts": [mid_pt1,mid_pt2], "end_planes": [pl1,pl2],
                          "dim": [0.07,0.07], "zAxis": axis_vec, "type": None,
                          "parent_bar": None, "parent_building": None,
                          "is_corner_vertical": False, "is_corner_diagonal": False,
                          "corner_diagonal_aligned_edge": None,
                          "is_opening_beam": False,
                          "parent_floor": None,
                          "parent_walls": [], "parent_slabs": [],
                          "is_window_main_beam": False,
                          "is_window_cross_beam": False,
                          "parent_module": None,
                          "ref_side_edge": None, 
                          "mesh": beam_mesh })
    beams.append(beam_object)
    beam_meshes.append(beam_object.mesh)
# ---------- end python ----------
# Tolerance analysis
crv = Curve([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])
# Lines are randomly drawn by hand. They are used to stablish connectivity
crv_2 = Curve([<curve referenced from the Rhino model> x166])
# Lines ordered as the beams(input)
list = ValueList({"0", "1", "2", "3", "4", "5", "6", "7", "8", "9"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}, selected="46")
crv_3 = Curve([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])
python_2 = PythonScript(beams=python.beams, edges=crv, joints=crv_2, selected_beam=list, generate_TextDot=Toggle(False))  # -> assembly_sequence, topology_edges, beam_mesh; inputs beams: list, edges: list of Curve, joints: list of Curve, selected_beam: Int32
# ---------- python_2: Python ----------
from tolerance_analysis import ToleranceNetwork
from compas_fab.fab.grasshopper.utilities import unload_modules 
unload_modules('tolerance_analysis')
from compas_fab.fab.geometry import Frame, Transformation
from compas.geometry.elements import Line
import rhinoscriptsyntax as rs
import Rhino.Geometry as rg
import Rhino
import scriptcontext as sc
import json
from System import Guid

#Generate Text Dot with the Beams order
if generate_TextDot==True:
    generated_textDot_list=[]
    for edge in edges:
        sc.doc = Rhino.RhinoDoc.ActiveDoc 
        generated_textDot_list.append(rs.AddTextDot("0",rs.CurveMidPoint(edge)))
        sc.doc = ghdoc
    data=[]
    for guid in generated_textDot_list:
        data.append(str(guid))
    with open(r"C:/Users/gandiaa/Documents/projects/tolerance_analysis/data170521.json", 'w') as filename:
        json.dump(data, filename)
with open(r"C:/Users/gandiaa/Documents/projects/tolerance_analysis/data170521.json", 'r') as filename:
    restored_data = json.load(filename)

#Filter DotText objects
objs = restored_data
textDotIDs=[]
for objsID in objs:
    if rs.IsTextDot(Guid.Parse(objsID))==True:
        textDotIDs.append(Guid.Parse(objsID))

#Get text from DotText
weights_list=[]
textDot_list=[]
for objsID in objs:
    weights_list.append(int(Rhino.RhinoDoc.ActiveDoc.Objects.Find(Guid.Parse(objsID)).Geometry.Text))
    textDot_list.append(Rhino.RhinoDoc.ActiveDoc.Objects.Find(Guid.Parse(objsID)).Geometry)

#Prepare edges and joints for Network
joint_list=[]
for joint in joints:
    joint_list.append(Line(joint.PointAtStart,joint.PointAtEnd))
    
edge_list=[]
for edge in edges:
    #edge_list.append(Line(edge.PointAt(0),edge.PointAt(edge.GetLength())))
    edge_list.append(Line(edge.PointAtStart,edge.PointAtEnd))


print beams

#Build Network
tolerance_network=ToleranceNetwork(joint_list, edge_list, beams, weights_list)

edge_joint=[]
for u,v,attr in tolerance_network.edges(data=True):
    if attr['edge_type']=='joint':
        coords_1 = tolerance_network.vertex_coordinates(u)
        coords_2 = tolerance_network.vertex_coordinates(v)
        pt_1 = rg.Point3d(coords_1[0],coords_1[1],coords_1[2])
        pt_2 = rg.Point3d(coords_2[0],coords_2[1],coords_2[2])
        edge_joint.append(rg.Line(pt_1,pt_2))

edge_beam=[]
for u,v,attr in tolerance_network.edges(data=True):
    if attr['edge_type']=='member':
        coords_1 = tolerance_network.vertex_coordinates(u)
        coords_2 = tolerance_network.vertex_coordinates(v)
        pt_1 = rg.Point3d(coords_1[0],coords_1[1],coords_1[2])
        pt_2 = rg.Point3d(coords_2[0],coords_2[1],coords_2[2])
        edge_beam.append(rg.Line(pt_1,pt_2))

#Iterate connectivity list according to slider and display edge selected and connected edges
connectivity_edges=[]
for u,v,attr in tolerance_network.edges(data=True):
    if attr['edge_type']=='member':
        temp_connectivity_edges=[]
        for connected_edge in attr['member_edge_nbrs']: 
            coords_1=tolerance_network.vertex_coordinates(connected_edge[0])
            coords_2=tolerance_network.vertex_coordinates(connected_edge[1])
            pt_1 = rg.Point3d(coords_1[0],coords_1[1],coords_1[2])
            pt_2 = rg.Point3d(coords_2[0],coords_2[1],coords_2[2])
            temp_connectivity_edges.append(rg.Line(pt_1,pt_2))
        coords_1=tolerance_network.vertex_coordinates(u)
        coords_2=tolerance_network.vertex_coordinates(v)
        pt_1 = rg.Point3d(coords_1[0],coords_1[1],coords_1[2])
        pt_2 = rg.Point3d(coords_2[0],coords_2[1],coords_2[2])
        temp_connectivity_edges.append(rg.Line(pt_1,pt_2))
        connectivity_edges.append(temp_connectivity_edges)
edge_connected=connectivity_edges[selected_beam]

#Display vertex as beam (beam_vertex) and edges as connections (topology_edges)
beam_vertex_list=[]
topology_edges=[]
for u, attr in tolerance_network.assembly_sequence_network.vertices(data=True):
    pt_1 = rg.Point3d(attr['x'],attr['y'],attr['z'])
    beam_vertex_list.append(pt_1)
    for vertex in tolerance_network.assembly_sequence_network.adjacency_dictionary[u]:
        coords_2= tolerance_network.assembly_sequence_network.vertex_coordinates(vertex)
        pt_2 = rg.Point3d(coords_2[0],coords_2[1],coords_2[2])
        topology_edges.append(rg.Line(pt_1,pt_2))

#Iterate according to MST order
beam_mesh=[]
vertices_list=[]
for u,v,attr in tolerance_network.edges(data=True):
    if attr['edge_type']=='member':
        beam_mesh.append(attr['beam'].mesh)

assembly_sequence=[]
for i in range(selected_beam+1):
    mst_index=tolerance_network.result[i]
    assembly_sequence.append(beam_mesh[int(mst_index)])
# ---------- end python_2 ----------
generate_beam_axes = PythonScript(beams=python.beams)  # -> out, a, b; inputs beams: list
# ---------- generate_beam_axes: Python ----------
from compas_fab.fab.geometry import Frame, Transformation
from compas.geometry.elements import Line
from compas.geometry.elements import Point
from compas.geometry.elements import Vector
import rhinoscriptsyntax as rs
import Rhino.Geometry as rg
import scriptcontext as sc

beam_axes=[]
beams_meshes=[]
for beam in beams:
    pt1=beam.axis_end_points[0]
    pt2=beam.axis_end_points[1]
    axis_vec_1=beam.axis_vec*(100)
    axis_vec_2=beam.axis_vec*(-100)
    new_pt1=rg.Vector3d.Add(rg.Vector3d(pt1),axis_vec_1) 
    new_pt2=rg.Vector3d.Add(rg.Vector3d(pt2),axis_vec_2) 
    beam_axis=rg.Line(rg.Point3d(new_pt1),rg.Point3d(new_pt2))
    beam_axes.append(beam_axis)
    beams_meshes.append(beam.mesh)
a=beam_axes
b=beams_meshes
# ---------- end generate_beam_axes ----------
generate_beam_number = PythonScript(edges=crv_3, generate=Toggle(False))  # -> out, a, b; inputs edges: list of Curve, generate: Boolean
# ---------- generate_beam_number: Python ----------
from compas_fab.fab.geometry import Frame, Transformation
from compas.geometry.elements import Line
from compas.geometry.elements import Point
from compas.geometry.elements import Vector
import rhinoscriptsyntax as rs
import Rhino.Geometry as rg
import scriptcontext as sc
print generate
if generate==True:
    for index, edge in enumerate(edges):
        rs.AddTextDot(str(index),rs.CurveMidPoint(edge))
    #    generated_textDot_list.append(rs.AddTextDot("0",rs.CurveMidPoint(edge)))
# ---------- end generate_beam_number ----------
mesh = Mesh(python_2.assembly_sequence)
# Example: concatenation of matrices
# based on list of frames and sequence
list_2 = ValueList({"0", "1", "2", "3", "4", "5", "6", "7", "8", "9"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}, selected="15")
list_3 = ValueList({"0", "1", "2", "3", "4", "5", "6", "7", "8", "9"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}, selected="0")
list_4 = ValueList({"0", "1", "2", "3", "4", "5", "6", "7", "8", "9"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}, selected="46")
# Example: urdf
python_3 = PythonScript()  # -> out, a
# ---------- python_3: Python ----------
from compas.geometry import Vector
from compas.geometry import transform_vectors
from compas.geometry import Transformation
from compas.geometry import Rotation
from compas.geometry import Translation
from compas.geometry import Line
from compas.geometry import Frame

class Origin(Frame):
    """
    """
    def __init__(self, point, xaxis, yaxis):
        super(Origin, self).__init__(point, xaxis, yaxis)
        self.init = Frame(point, xaxis, yaxis)

    def reset_transform(self):
        cp = self.init.copy()
        self.point = cp.point
        self.xaxis = cp.xaxis
        self.yaxis = cp.yaxis


class Axis(Vector):
    """
    """
    def __init__(self, x, y, z):
        super(Axis, self).__init__(x, y, z)
        self.init = Vector(x, y, z)

    def reset_transform(self):
        cp = self.init.copy()
        self.x = cp.x
        self.y = cp.y
        self.z = cp.z


class Joint(object):
    """
    """
    REVOLUTE = 0
    CONTINUOUS = 1 
    PRISMATIC = 2
    FIXED = 3
    FLOATING = 4 
    PLANAR = 5

    def __init__(self, name, type, parent, child, origin=None, axis=None):
        self.name = name
        self.type = type
        self.origin = origin
        self.axis = axis
        self.parent = parent
        self.child = child
        self.parent_link = None
        self.child_link = None
        self.position = 0  # the position of the joint

    @property
    def current_transformation(self):
        if self.origin:
            return Transformation.from_frame(self.origin)
        else:
            return Transformation()

    @property
    def init_transformation(self):
        if self.origin:
            return Transformation.from_frame(self.origin.init)
        else:
            return Transformation()

    def reset_transform(self):
        if self.origin:
            self.origin.reset_transform()
        if self.axis:
            self.axis.reset_transform()

    def transform(self, transformation):
        if self.origin:
            self.origin.transform(transformation)
        if self.axis:
            self.axis.transform(transformation)
    
    def calculate_transformation(self, position):
        """Calculates the transformation of the joint based on the position and
        its type.
        """
        if self.type in [Joint.REVOLUTE, Joint.CONTINUOUS]:
            return Rotation.from_axis_and_angle(self.axis, position, self.origin.point)
        elif self.type == Joint.PRISMATIC:
            return Translation(self.axis * position)
        elif self.type == Joint.FIXED:
            return Transformation() # identity matrix
        elif self.type == Joint.FLOATING:
            raise NotImplementedError
        else: # == Joint.PLANAR
            raise NotImplementedError

    def calculate_reset_transformation(self):
        return self.init_transformation * self.current_transformation.inverse()
    
    def is_configurable(self):
        return self.type != Joint.FIXED



class Link(object):
    """
    """

    def __init__(self, name, geometry=None):
        self.name = name
        self.geometry = geometry
        self.joints = []
        self.parent_joint = None

    def update(self, joint_state, parent_transformation, reset_transformation):
        """Recursive function to apply the transformations given by the joint
            state.
        Joint_states are given absolute, so it is necessary to reset the current
        transformation.
        Args:
            joint_state (dict): A dict with the joint names as keys and positions 
                as values in radians and mm (depending on the joint type)
            parent_transformation (:class:`Transformation`): The transfomation 
                of the parent joint
            reset_transformation (:class:`Transformation`): The transfomation 
                to reset the current transformation of the link's geometry.
        """
        relative_transformation = parent_transformation * reset_transformation

        if self.geometry:
            self.geometry.transform(relative_transformation)
        
        for joint in self.joints:
            # 1. Get reset transformation
            reset_transformation = joint.calculate_reset_transformation()
            # 2. Reset
            joint.reset_transform()
            #joint.transform(reset_transformation) # why does this not work properly....

            # 3. Calculate transformation
            if joint.name in joint_state.keys():
                position = joint_state[joint.name]
                transformation = joint.calculate_transformation(position)
                transformation = parent_transformation * transformation
                joint.position = position
            else:
                transformation = parent_transformation

            # 4. Apply on joint
            joint.transform(transformation)
            # 4. Apply function to all children
            joint.child_link.update(joint_state, transformation, reset_transformation)


class Model(object):

    def __init__(self):
        self.joints = []
        self.links = []
        self.root = None

    def add_link(self, link):
        self.links.append(link)

    def add_joint(self, joint):
        self.joints.append(joint)

    def get_link_by_name(self, name):
        for link in self.links:
            if link.name == name:
                return link
        return None

    def get_joint_by_name(self, name):
        for joint in self.joints:
            if joint.name == name:
                return joint
        return None

    def build_tree(self):
        for joint in self.joints:
            parent_link = self.get_link_by_name(joint.parent)
            joint.parent_link = parent_link
            parent_link.joints.append(joint)
            child_link = self.get_link_by_name(joint.child)
            joint.child_link = child_link
            child_link.parent_joint = joint
        # search root link
        for link in self.links:
            if not link.parent_joint:
                self.root = link
                break

    def update(self, joint_state):
        # joint states are absolute
        self.root.update(joint_state, Transformation(), Transformation())

    def get_geometry(self):
        geometry = []
        for link in self.links:
            if link.geometry:
                geometry.append(link.geometry)
        return geometry



if __name__ == "__main__":
    
    model = Model()
    base_link = Link("base_link")
    joint0 = Joint("joint0", Joint.REVOLUTE, "base_link", "link0", origin=Origin.worldXY(), axis=Axis(0,0,1))
    link0 = Link("link0", Line([0,0,0], [0,0,100]))
    joint1 = Joint("joint1", Joint.REVOLUTE, "link0", "link1", origin=Origin([0,0,100],[1,0,0],[0,1,0]), axis=Axis(1,0,0))
    link1 = Link("link1", Line([0,0,100], [200,0,100]))
    joint2 = Joint("joint2", Joint.PRISMATIC, "link1", "link2", origin=Origin([200,0,100],[1,0,0],[0,1,0]), axis=Axis(0,0,1))
    link2 = Link("link2", Line([200,0,100], [200,0,300]))
    joint3 = Joint("joint3", Joint.REVOLUTE, "link2", "link3", origin=Origin([200,0,300],[1,0,0],[0,1,0]), axis=Axis(1,0,0))
    link3 = Link("link3", Line([200,0,300], [0,0,300]))

    model.add_link(base_link)
    model.add_link(link0)
    model.add_link(link1)
    model.add_link(link2)
    model.add_link(link3)
    model.add_joint(joint0)
    model.add_joint(joint1)
    model.add_joint(joint2)
    model.add_joint(joint3)
    model.build_tree() # important!

    import math
    import Rhino.Geometry as rg
    
    a0, a1, a2, a3 = 0.104, -0.506, 41.0, 0.436
    joint_positions = [a0, a1, a2, a3]
    joint_names = ["joint0", "joint1", "joint2", "joint3"]
    
    joint_state = {}
    for k,v in zip(joint_names, joint_positions):
        joint_state[k] = v
    
    model.update(joint_state)
    lines = model.get_geometry()
    
    rglines = []
    for line in lines:
        start, end = rg.Point3d(*list(line.start)), rg.Point3d(*list(line.end))
        rglines.append(rg.Line(start, end))
# ---------- end python_3 ----------
list_5 = ValueList({"0", "1", "2", "3", "4", "5", "6", "7", "8", "9"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}, selected="5")
item = ListItem(List=python.beams, Index=[list_2, list_3, list_4], Wrap=True)
propagation_example = PythonScript(beams=item, frame_n=list_5)  # -> out, display_frame; inputs beams: list
# ---------- propagation_example: Python ----------
from tolerance_analysis import ToleranceNetwork
from compas_fab.fab.grasshopper.utilities import unload_modules 
unload_modules('tolerance_analysis')
from compas_fab.fab.geometry import Frame, Transformation, Translation
from compas.geometry.elements import Line
from compas_fab.fab.grasshopper.utilities.drawing import xdraw_frame
import rhinoscriptsyntax as rs
import Rhino.Geometry as rg
import Rhino
import scriptcontext as sc

#Extra functions for transform in own frame
def translate_frame_own_x(transformation, distance):
    x_transform = [[1, 0, 0, (transformation[0, 0] * distance)],
                   [0, 1, 0, (transformation[1, 0] * distance)],
                   [0, 0, 1, (transformation[2, 0] * distance)],
                   [0, 0, 0, 1]]
    return Translation.from_matrix(x_transform)

def translate_frame_own_y(transformation,  distance):
    y_transform = [[1, 0, 0, (transformation[0, 1]*distance)],
                   [0, 1, 0, (transformation[1, 1]*distance)],
                   [0, 0, 1, (transformation[2, 1]*distance)],
                   [0, 0, 0, 1]]
    return Translation.from_matrix(y_transform)

def translate_frame_own_z(transformation,  distance):
    z_transform = [[1, 0, 0, (transformation[0, 2]*distance)],
                   [0, 1, 0, (transformation[1, 2]*distance)],
                   [0, 0, 1, (transformation[2, 2]*distance)],
                   [0, 0, 0, 0]]
    return Translation.from_matrix(z_transform)

#Build rhino and compas plane lists

rhino_planes=[]
compas_frames=[]
for i in range(len(beams)):
    rhino_plane_A=beams[i].end_planes[0]
    rhino_plane_B=beams[i].end_planes[1]
    rhino_planes.append(rhino_plane_A)
    rhino_planes.append(rhino_plane_B)
    compas_frame_A=Frame(rhino_plane_A[0],rhino_plane_A[1],rhino_plane_A[2])
    compas_frame_B=Frame(rhino_plane_B[0],rhino_plane_B[1],rhino_plane_B[2])
    compas_frames.append(compas_frame_A)
    compas_frames.append(compas_frame_B)

#Re-order planes (needs to be improved)
for i in range(len(rhino_planes)):
    #check first vertex plane
    if i%2==0:
        origin=rhino_planes[i].Origin
        next_origin=rhino_planes[i-1].Origin
        #if it is not v1 alter list order
        if origin.DistanceTo(next_origin)>100 and i!=0:
            temp_plane=rhino_planes[i]
            temp_frame=compas_frames[i]
            rhino_planes.pop(i)
            rhino_planes.append(temp_plane)
            compas_frames.pop(i)
            compas_frames.append(temp_frame)
"""
#Example of translating frame on its own frame
#Get transformation to frame
origin_V0=Transformation.from_frame(compas_frames[0])
#Get transformation to shifted frame
tolerance=translate_frame_own_z(origin_V0, 100)
#Multiply them
M1=tolerance*origin_V0
#Display new frame
a=xdraw_frame(Frame.from_transformation(M1))
"""
#Build relations(transformations) for ordered frames (Hard coded)
def add_tolerance(frame):
    #Example of translating frame on its own frame
    #Get transformation to frame
    origin_V0=Transformation.from_frame(frame)
    #Get transformation to shifted frame
    tolerance=translate_frame_own_z(origin_V0, 100)
    #Multiply them
    M1=tolerance*origin_V0
    return Frame.from_transformation(M1)

transformations=[]
#Transformation 0,0,0 to V0
origin_V0=Transformation.from_frame(compas_frames[0])
transformations.append(origin_V0)
#Transformation to V1
#V0-V1*origin
V0_V1=Transformation.from_frame_to_frame(compas_frames[0], compas_frames[1])
tr_V1=V0_V1*origin_V0
transformations.append(tr_V1)
#joint transformation with tolerance
V1_V2_tlr=Transformation.from_frame_to_frame(compas_frames[1], add_tolerance(compas_frames[2]))
#joint transformation no tolerance
V1_V2=Transformation.from_frame_to_frame(compas_frames[1], compas_frames[2])
tr_V2=V1_V2*tr_V1
tr_V2_tlr=V1_V2_tlr*tr_V1
transformations.append(tr_V2_tlr)
#Transformation to V3
#V2-V3*V1-V2*V0-V1*origin)
V2_V3=Transformation.from_frame_to_frame(compas_frames[1], compas_frames[3])
tr_V3=V2_V3*tr_V2_tlr

a=V0_V1*origin_V0
b=V1_V2_tlr.inverse()*a
c=V2_V3*b

transformations.append(tr_V3)
#Transformation to V4
#V3-V4*V2-V3*V1-V2*V0-V1*origin)
V3_V4=Transformation.from_frame_to_frame(compas_frames[3], compas_frames[4])
tr_V4=V3_V4*tr_V3
transformations.append(tr_V4)
#Transformation to V5
#V4-V5*V3-V4*V2-V3*V1-V2*V0-V1*origin)
V4_V5=Transformation.from_frame_to_frame(compas_frames[4], compas_frames[5])
tr_V5=V4_V5*tr_V4
transformations.append(tr_V5)

#Display frames
#transformations=concatenate_frames(compas_frames)
transform=transformations[int(frame_n)]
display_frame=xdraw_frame(Frame.from_transformation(transform))




#Build relations(transformations) for ordered frames (autimated)
def concatenate_frames(frames):
    #Skip 2 first frames
    transformations=[]
    #Transformation 0,0,0 to V0
    origin_V0=Transformation.from_frame(frames[0])
    transformations.append(origin_V0)
    #Transformation to V1
    #V0-V1*origin
    V0_V1=Transformation.from_frame_to_frame(frames[0],frames[1])
    tr_V1=V0_V1*origin_V0
    transformations.append(tr_V1)
    for i in range(1,len(frames),1):
        if i!=int(len(frames)-1):
            #generate beam transformation
            if i%2!=0:
                print "a",i,i+1
                Vi_Vii=Transformation.from_frame_to_frame(frames[i], frames[i+1])
                tr_Vii=Vi_Vii*transformations[i]
                transformations.append(tr_Vii)
            #generate joint transformation
            else:
                print "b",i,i+1
                Vi_Vii=Transformation.from_frame_to_frame(frames[i], frames[i+1])
                tr_Vii=Vi_Vii*transformations[i]
                transformations.append(tr_Vii)
    return transformations
"""
#call automated function
transformations=concatenate_frames(compas_frames)
#display frames
transform=transformations[int(frame_n)]

display_frame=xdraw_frame(Frame.from_transformation(transform))
"""
# ---------- end propagation_example ----------
