# Grasshopper definition 181018_DisplayAxialDeformationAsRotation.gh (Grasshopper 0.9.76)
# plug-ins: Python Interpreter

python = PythonScript()  # -> out, mid_point, deviation, beam_end, polylines, sensor_plane
# ---------- python: Python ----------
from compas_fab.fab.grasshopper.utilities import unload_modules 
from compas_fab.fab.geometry import Frame, Transformation, Translation, Rotation
from compas.geometry.elements import Line, Point, Vector
import rhinoscriptsyntax as rs
import Rhino.Geometry as rg
import Rhino
import scriptcontext as sc
from compas_fab.fab.grasshopper.utilities.drawing import xdraw_frame, xdraw_lines
import math
from material_tolerances_correction.helpers import storage
from compas.geometry import project_point_plane

beam_indexes=[34,4,3,7,2,6,67,36,35,34,32,43,8,9,69,70,72,83,85,36,41,22]
files=['sensor_data_20180416.tab','sensor_data_20180415.tab','sensor_data_20180415.tab','sensor_data_20180415.tab','sensor_data_20180415.tab','sensor_data_20180415.tab'
    ,'sensor_data_20180410.tab','sensor_data_20180410.tab','sensor_data_20180410.tab','sensor_data_20180410.tab','sensor_data_20180410.tab'
    ,'sensor_data_20180409.tab','sensor_data_20180406.tab','sensor_data_20180406.tab','sensor_data_20180316.tab','sensor_data_20180316.tab'
    ,'sensor_data_20180316.tab','sensor_data_20180227.tab','sensor_data_20180227.tab','sensor_data_20180223.tab','sensor_data_20180222.tab','sensor_data_20180215.tab']
modules=['(41, 20, 22, 18, 46, 44)','(41, 20, 22, 18, 46, 44)','(41, 20, 22, 18, 46, 44)','(41, 20, 22, 18, 46, 44)','(41, 20, 22, 18, 46, 44)','(41, 20, 22, 18, 46, 44)','(28, 20, 11, 4)','(28, 20, 11, 4)','(28, 20, 11, 4)','(28, 20, 11, 4)','(28, 20, 11, 4)','(28, 20, 11, 4)','(28, 20, 11, 4)','(28, 20, 11, 4)','(5, 17, 8, 7, 3, 2)','(5, 17, 8, 7, 3, 2)','(5, 17, 8, 7, 3, 2)','(5, 30, 21, 12, 13, 10)','(5, 30, 21, 12, 13, 10)','(5, 30, 21, 12, 13, 10)','(5, 30, 21, 12, 13, 10)','(5, 30, 21, 12, 13, 10)']

deviations=[[10.80900391,11.81817932	,10.19497266],
            [6.918378906,1.277148404,2.369029663],
            [9.161542969,	0.09404296876,	0.29749646],
            [10.34513672,	-0.2456748962	,3.091685913],
            [5.246503906,	3.367479838	,1.937633179],
            [9.686933594,	-2.261118698,	3.36024823],
            [0.6957226563,	3.717471313	,6.585597656],
            [4.517011751,	7.282776546	,2.818507813],
            [3.276777376,	2.319316101	,-0.5608867187],
            [5.234296907,	-0.5570743561	,-0.626041748],
            [6.819746126,	0.6787626266,	0.2396732788],
            [-6.721269499,	-11.2595154	,0.2762562256],
            [8.296083527,	-10.33089905,	0.776969574],
            [11.2855378,	4.093249512	,4.684001587],
            [0.7662564087,	5.059242916	,-2.348728516],
            [0.2114926147,	5.609065485	,-1.701267578],
            [1.041112976,	10.38697929	,-0.33090625],
            [-2.932005806,	-3.989689636,	-10.40756641],
            [-7.882438107,	-0.2169616699,	-6.394871094],
            [18.94718756,	1.149859619,	4.652026794],
            [16.33585938,	3.791552734,	-3.617054321],
            [14.22453126,	-2.987077999,	-3.988132813]]


def translate_frame_own_xyz(transformation,x_dist, y_dist, z_dist):
            x_transform = [[1, 0, 0, (transformation[0, 0] * x_dist)],
                           [0, 1, 0, (transformation[1, 0] * x_dist)],
                           [0, 0, 1, (transformation[2, 0] * x_dist)],
                           [0, 0, 0, 1]]
            y_transform = [[1, 0, 0, (transformation[0, 1]*y_dist)],
                           [0, 1, 0, (transformation[1, 1]*y_dist)],
                           [0, 0, 1, (transformation[2, 1]*y_dist)],
                           [0, 0, 0, 1]]
            z_transform = [[1, 0, 0, (transformation[0, 2]*z_dist)],
                           [0, 1, 0, (transformation[1, 2]*z_dist)],
                           [0, 0, 1, (transformation[2, 2]*z_dist)],
                           [0, 0, 0, 0]]

            return Translation.from_matrix(z_transform)*Translation.from_matrix(y_transform)*Translation.from_matrix(x_transform)

#Origin
origin_frame=Frame([0, 0, 0], [1, 0, 0], [0, 1, 0])
#Sensor ray
sensor_plane=Frame([11351.8121257605-16, 4349.44992333368,  1190.41041511163],[-0.00507013849708529, -0.999987146765208, 0],[-0.999872073720525, 0.00506955505331232, -0.0151702275981074])
T_sensor_ray=Transformation.from_frame(sensor_plane)
T_rensor_ray_y=Frame([0, 0, 0], [1, 0, 0], [0, 1, 0])
r2=Rotation.from_axis_and_angle(origin_frame.yaxis,math.radians(90))
T_rensor_ray_y.transform(r2)
T_rensor_ray_y.transform(T_sensor_ray)
T_rensor_ray_x=Frame([0, 0, 0], [1, 0, 0], [0, 1, 0])
r3=Rotation.from_axis_and_angle(origin_frame.xaxis,math.radians(90))
#Project on plane
T_rensor_ray_x.transform(r3)
T_rensor_ray_x.transform(T_sensor_ray)

mid_point=[]
deviation=[]
beam_end=[]
lines=[]
axial_shift_x=[]
axial_shift_y=[]

for i in range(len(files)):
    dictio=storage.read('C:\\Users\\gandiaa\\Documents\\projects\\material_tolerances_correction\\data\\'+files[i],modules[i],beam_indexes[i]) 
    robot_plane_origin_x= dictio.get('points')[4]['robot_plane_origin_x']
    robot_plane_origin_y= dictio.get('points')[4]['robot_plane_origin_y']
    robot_plane_origin_z= dictio.get('points')[4]['robot_plane_origin_z']
    
    robot_plane_xaxis_x= dictio.get('points')[4]['robot_plane_xaxis_x']
    robot_plane_xaxis_y= dictio.get('points')[4]['robot_plane_xaxis_y']
    robot_plane_xaxis_z= dictio.get('points')[4]['robot_plane_xaxis_z']
    
    robot_plane_yaxis_x= dictio.get('points')[4]['robot_plane_yaxis_x']
    robot_plane_yaxis_y= dictio.get('points')[4]['robot_plane_yaxis_y']
    robot_plane_yaxis_z= dictio.get('points')[4]['robot_plane_yaxis_z']
    
    grip_plane_nest_origin_x= dictio.get('points')[4]['grip_plane_nest_origin_x']
    grip_plane_nest_origin_y= dictio.get('points')[4]['grip_plane_nest_origin_y']
    grip_plane_nest_origin_z= dictio.get('points')[4]['grip_plane_nest_origin_z']
    
    grip_plane_nest_xaxis_x= dictio.get('points')[4]['grip_plane_nest_xaxis_x']
    grip_plane_nest_xaxis_y= dictio.get('points')[4]['grip_plane_nest_xaxis_y']
    grip_plane_nest_xaxis_z= dictio.get('points')[4]['grip_plane_nest_xaxis_z']
    
    grip_plane_nest_yaxis_x=dictio.get('points')[4]['grip_plane_nest_yaxis_x']
    grip_plane_nest_yaxis_y=dictio.get('points')[4]['grip_plane_nest_yaxis_y']
    grip_plane_nest_yaxis_z=dictio.get('points')[4]['grip_plane_nest_yaxis_z']
    
    beam_mid_point_origin_x=dictio.get('points')[4]['beam_mid_point_origin_x']
    beam_mid_point_origin_y=dictio.get('points')[4]['beam_mid_point_origin_y']
    beam_mid_point_origin_z=dictio.get('points')[4]['beam_mid_point_origin_z']
    
    beam_mid_point_xaxis_x=dictio.get('points')[4]['beam_mid_point_xaxis_x']
    beam_mid_point_xaxis_y=dictio.get('points')[4]['beam_mid_point_xaxis_y']
    beam_mid_point_xaxis_z=dictio.get('points')[4]['beam_mid_point_xaxis_z']
    
    beam_mid_point_yaxis_x=dictio.get('points')[4]['beam_mid_point_yaxis_x']
    beam_mid_point_yaxis_y=dictio.get('points')[4]['beam_mid_point_yaxis_y']
    beam_mid_point_yaxis_z=dictio.get('points')[4]['beam_mid_point_yaxis_z']
    
    beam_axis_end_point_zero_x=dictio.get('points')[4]['beam_axis_end_point_zero_x']
    beam_axis_end_point_zero_y=dictio.get('points')[4]['beam_axis_end_point_zero_y']
    beam_axis_end_point_zero_z=dictio.get('points')[4]['beam_axis_end_point_zero_z']
    
    #robot plane SENSOR
    rob_plane_origin_0=Frame([robot_plane_origin_x, robot_plane_origin_y, robot_plane_origin_z], [robot_plane_xaxis_x,robot_plane_xaxis_y,robot_plane_xaxis_z], [robot_plane_yaxis_x,robot_plane_yaxis_y,robot_plane_yaxis_z])
    #mid point NEST 
    beam_mid_point_nest_0=Frame([beam_mid_point_origin_x,beam_mid_point_origin_y,beam_mid_point_origin_z],[beam_mid_point_xaxis_x,beam_mid_point_xaxis_y,beam_mid_point_xaxis_z],[beam_mid_point_yaxis_x,beam_mid_point_yaxis_y,beam_mid_point_yaxis_z])
    #gripping point NEST
    gripping_point_nest_0=Frame([grip_plane_nest_origin_x,grip_plane_nest_origin_y,grip_plane_nest_origin_z],[grip_plane_nest_xaxis_x,grip_plane_nest_xaxis_y,grip_plane_nest_xaxis_z],[grip_plane_nest_yaxis_x,grip_plane_nest_yaxis_y,grip_plane_nest_yaxis_z])
    
    #beam mid point SENSOR
    T1_0=Transformation.from_frame(gripping_point_nest_0)
    T2_0=Transformation.from_frame(beam_mid_point_nest_0)
    T3_0=Transformation.from_frame(rob_plane_origin_0)
    T2_inv_0=T1_0.inverse()*T2_0
    T_mid_pt_0=T3_0*T2_inv_0
    #face beam deviation (centroid)
    sensor_offset=200
    deviation_0=T_sensor_ray*translate_frame_own_xyz(T_sensor_ray,deviations[4][0],deviations[4][1],deviations[4][2]+sensor_offset)
    
    #beam_axis_end_point_zero_SENSOR
    beam_axis_end_point_zero_x=Frame([beam_axis_end_point_zero_x,beam_axis_end_point_zero_y,beam_axis_end_point_zero_z], [1,0,0], [0,1,0])
    T4_0=Transformation.from_frame(beam_axis_end_point_zero_x)
    T5_inv_0=T1_0.inverse()*T4_0
    T_end_pt_0_fake=T3_0*T5_inv_0
    T_end_pt_0_origin=T_mid_pt_0.inverse()*T_end_pt_0_fake
    r1=Rotation.from_axis_and_angle(origin_frame.yaxis,math.radians(180))
    T_end_pt_0_r1=r1*T_end_pt_0_origin
    T_end_pt_0=T_mid_pt_0*T_end_pt_0_r1
    
    #display frames
    mid_frame=Frame.from_transformation(T_mid_pt_0)
    deviation_frame=Frame.from_transformation(deviation_0)
    beam_end_frame=Frame.from_transformation(T_end_pt_0)
    
    mid_point.append(xdraw_frame(mid_frame))
    deviation.append(xdraw_frame(deviation_frame))
    beam_end.append(xdraw_frame(beam_end_frame))
    
    #Deviation in x
    mid_frame_x=project_point_plane(mid_frame.point,(T_rensor_ray_x.point,T_rensor_ray_x.zaxis))
    deviation_frame_x=project_point_plane(deviation_frame.point,(T_rensor_ray_x.point,T_rensor_ray_x.zaxis))
    beam_end_frame_x=project_point_plane(beam_end_frame.point,(T_rensor_ray_x.point,T_rensor_ray_x.zaxis))
    
    x_ideal_pt_sensor_plane=project_point_plane(beam_end_frame_x,(sensor_plane.point,sensor_plane.zaxis))
    x_recons_pt_sensor_plane=project_point_plane(deviation_frame_x,(sensor_plane.point,sensor_plane.zaxis))
    
    dev_x=rs.AddLine(x_ideal_pt_sensor_plane,x_recons_pt_sensor_plane)
    dev_x_mm=rs.CurveLength(dev_x)
    axial_shift_x.append(dev_x_mm)
    
    #Deviation in y
    mid_frame_y=project_point_plane(mid_frame.point,(T_rensor_ray_y.point,T_rensor_ray_y.zaxis))
    deviation_frame_y=project_point_plane(deviation_frame.point,(T_rensor_ray_y.point,T_rensor_ray_y.zaxis))
    beam_end_frame_y=project_point_plane(beam_end_frame.point,(T_rensor_ray_y.point,T_rensor_ray_y.zaxis))
    
    y_ideal_pt_sensor_plane=project_point_plane(beam_end_frame_y,(sensor_plane.point,sensor_plane.zaxis))
    y_recons_pt_sensor_plane=project_point_plane(deviation_frame_y,(sensor_plane.point,sensor_plane.zaxis))
    
    dev_y=rs.AddLine(y_ideal_pt_sensor_plane,y_recons_pt_sensor_plane)
    dev_y_mm=rs.CurveLength(dev_y)
    axial_shift_y.append(dev_y_mm)
    
sensor_plane=xdraw_frame(sensor_plane)
# ---------- end python ----------
crv = Curve(python.polylines)
pln = Plane(python.sensor_plane)
reconstruct = PythonScript(show_on_nest=Toggle(False), selected_beam=Slider(0, range=0..20))  # -> labels_positions, reconstructed_beams, measured_points, ideal_measurement_points, thickness_difference, height_difference, axial_shift_x, axial_shift_y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; inputs beam_data: list, selected_beam: Int32
# ---------- reconstruct: Python ----------
import math
import Rhino.Geometry as rg
import rhinoscriptsyntax as rs

from compas_fab.fab.geometry.helpers import mesh_transform
from compas_fab.fab.geometry import Transformation, Frame, Rotation
from compas_fab.fab.grasshopper import unload_modules
from compas_fab.fab.grasshopper.utilities.drawing import xdraw_frame
from compas.geometry import project_point_plane

unload_modules('material_tolerances_correction')

from material_tolerances_correction.reconstruction import reconstruct_from_sensor
from material_tolerances_correction.reconstruction.sensor import reconstruct_measured_frames_from_sensor_data, load_sensor_data, load_validated_data_set, match_building_beams, translate_to_building, calculate_compound_deformation, get_rhino_plane_from_data
from material_tolerances_correction.measurements.frame_generator import get_measure_data_for_procedure, SENSOR_RAY_PLANE
from material_tolerances_correction.helpers import transformation_from_plane, storage

beam_scans = load_validated_data_set()

print('Found %d scanned beams' % len(beam_scans))

digital_beam = []
reconstructed_beams = []
ideal_measurement_points = []
measured_points = []
labels = []
labels_positions = []

T_sensor_ray=Frame([11351.8121257605-16, 4349.44992333368,  1190.41041511163],[-0.00507013849708529, -0.999987146765208, 0],[-0.999872073720525, 0.00506955505331232, -0.0151702275981074])
T_sensor_ray=xdraw_frame(T_sensor_ray)

for beam_scan in beam_scans:
    
    #digital_beam.append(model_mesh)
    grip_plane_nest = get_rhino_plane_from_data('grip_plane_nest', beam_scan)
    mid_point = get_rhino_plane_from_data('beam_mid_point', beam_scan)

    # Gripping plane of beam at NEST (Helmi)
    T1 = transformation_from_plane(grip_plane_nest)

    # Mid point of beam at NEST (Arash)
    T2 = transformation_from_plane(mid_point)

    # Gripping plane at origin (offset of Helmi vs Arash)
    M1 = T2.inverse()*T1

    beam_scan['meta']['source_gripping_plane_rotation'] = round(math.degrees(M1.rotation().axis_angle_vector[0]), 0)

    beam_details = {'half_thickness': beam_scan['points'][0]['beam_half_thickness'],
                    'half_height': beam_scan['points'][0]['beam_half_height'],
                    'mid_point': mid_point,
                    'axis_end_point_zero': storage.get_xyz('beam_axis_end_point_zero', beam_scan['points'][0])}

    ideal_measuring_frames = reconstruct_measured_frames_from_sensor_data(beam_details, beam_scan, False)
    _, ideal_points = reconstruct_from_sensor(ideal_measuring_frames, include_points='measured_points')
    measured_frames = reconstruct_measured_frames_from_sensor_data(beam_details, beam_scan, True)
    beam_reconstructed, points = reconstruct_from_sensor(measured_frames, include_points='measured_points')
    beam_scan['meta']['beam_reconstructed'] = beam_reconstructed
    #beam_scan['meta']['beam_reconstructed'] = beam_reconstructed
    if show_on_nest:
        translate_to_building(beam_scan, points=points)
    if points:
        measured_points.append(points)
    if ideal_points:
        ideal_measurement_points.append(ideal_points)
    reconstructed_beams.append(beam_reconstructed)
    
beam_scans.pop(0)
beam_scans.pop(5)
measured_points.pop(0)
measured_points.pop(5)
ideal_measurement_points.pop(0)
ideal_measurement_points.pop(5)

thickness_difference=[]
height_difference=[]
for i in range(len(measured_points)):
    thickness_1=rs.Distance(measured_points[i][0],measured_points[i][3])
    thickness_2=rs.Distance(measured_points[i][1],measured_points[i][2])
    ideal_half_thickness=beam_scans[i]['points'][0]['beam_half_thickness']*2
    if ideal_half_thickness-thickness_1<2:
        thickness_difference.append(ideal_half_thickness-thickness_1)
    if ideal_half_thickness-thickness_2<2:
        thickness_difference.append(ideal_half_thickness-thickness_2)
    height_1=rs.Distance(measured_points[i][4],measured_points[i][7])
    height_2=rs.Distance(measured_points[i][5],measured_points[i][6])
    ideal_half_height=beam_scans[i]['points'][0]['beam_half_height']*2
    if ideal_half_height-height_1>0:
        height_difference.append(ideal_half_height-height_1)
    if ideal_half_height-height_2>0:
        height_difference.append(ideal_half_height-height_2)

##7#6##
#0    3
#     #
#     #
#1    2
##4#5##

#Get beam frames
origin_frame=Frame([0, 0, 0], [1, 0, 0], [0, 1, 0])
#Sensor ray
sensor_plane=Frame([11351.8121257605-16, 4349.44992333368,  1190.41041511163],[-0.00507013849708529, -0.999987146765208, 0],[-0.999872073720525, 0.00506955505331232, -0.0151702275981074])
T_sensor_ray=Transformation.from_frame(sensor_plane)
T_rensor_ray_y=Frame([0, 0, 0], [1, 0, 0], [0, 1, 0])
r2=Rotation.from_axis_and_angle(origin_frame.yaxis,math.radians(90))
T_rensor_ray_y.transform(r2)
T_rensor_ray_y.transform(T_sensor_ray)
T_rensor_ray_x=Frame([0, 0, 0], [1, 0, 0], [0, 1, 0])
r3=Rotation.from_axis_and_angle(origin_frame.xaxis,math.radians(90))
#Project pts on plane 
T_rensor_ray_x.transform(r3)
T_rensor_ray_x.transform(T_sensor_ray)
y_beam_plane=xdraw_frame(T_rensor_ray_y)
x_beam_plane=xdraw_frame(T_rensor_ray_x)

centroid_temp=Frame.from_transformation(T_sensor_ray)
centroid=project_point_plane(centroid_temp.point,(sensor_plane.point,sensor_plane.zaxis))

axial_shift_x=[]
axial_shift_y=[]
ideal_lines=[]
measured_lines=[]
axial_rotation=[]
for i in range(len(measured_points)):
    for j in range(8):
        # ideal pt on plane x
        ideal_pt_plane_x=project_point_plane(ideal_measurement_points[i][j],(T_rensor_ray_x.point,T_rensor_ray_x.zaxis))
        # measured pt on plane x
        measured_pt_plane_x=project_point_plane(measured_points[i][j],(T_rensor_ray_x.point,T_rensor_ray_x.zaxis))
        axial_shift_x.append(rs.Distance(ideal_pt_plane_x,measured_pt_plane_x))
        # ideal pt on plane y
        ideal_pt_plane_y=project_point_plane(ideal_measurement_points[i][j],(T_rensor_ray_y.point,T_rensor_ray_y.zaxis))
        # measured pt on plane y
        measured_pt_plane_y=project_point_plane(measured_points[i][j],(T_rensor_ray_y.point,T_rensor_ray_y.zaxis))
        axial_shift_y.append(rs.Distance(ideal_pt_plane_y,measured_pt_plane_y))
        ideal_measurement_points_on_plane=project_point_plane(ideal_measurement_points[i][j],(centroid_temp.point,centroid_temp.zaxis))
        measurement_points_on_plane=project_point_plane(measured_points[i][j],(centroid_temp.point,centroid_temp.zaxis))
        #ideal line
        ideal_line=rs.AddLine(centroid,ideal_measurement_points_on_plane)
        ideal_lines.append(ideal_line)
        measured_line=rs.AddLine(centroid,measurement_points_on_plane)
        measured_lines.append(measured_line)
        axial_rotation.append(rs.Angle2(ideal_line,measured_line)[0])
        
centroid_temp=xdraw_frame(centroid_temp)

measured_points=measured_points[selected_beam]
ideal_measurement_points=ideal_measurement_points[selected_beam]
# ---------- end reconstruct ----------
line = Line(reconstruct.ideal_lines)
panel = Panel(reconstruct.axial_shift_x)
panel_2 = Panel(reconstruct.axial_shift_y)
panel_3 = Panel(reconstruct.thickness_difference)
panel_4 = Panel(reconstruct.height_difference)
line_2 = Line(reconstruct.measured_lines)
pln_2 = Plane(reconstruct.centroid_temp)
panel_5 = Panel(reconstruct.axial_rotation)
pt = Point(reconstruct.measured_points)
pt_2 = Point(reconstruct.ideal_measurement_points)
