# Grasshopper definition 181110_ToleranceAnalysisModule_PringleModule.ghx (Grasshopper 0.9.76)
# plug-ins: Python Interpreter

list = ValueList({"0", "1", "2", "3", "4", "5", "6", "7", "8", "9"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}, selected="2")
# Module 1
brep = Brep([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])
# Complete structure
brep_2 = Brep([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])
python = PythonScript(beams_geo=brep_2)  # -> out, beams, beam_meshes; inputs beams_geo: list of Brep
# ---------- python: Python ----------
from tolerance_analysis import beam
from compas_fab.fab.grasshopper.utilities import unload_modules 
unload_modules('tolerance_analysis')
unload_modules('spatial_timber_assemblies')
import rhinoscriptsyntax as rs
import Rhino.Geometry as rg
import scriptcontext as sc
tolerance = sc.doc.ModelAbsoluteTolerance

beams=[]
beam_meshes=[]
for i in range(len(beams_geo)):
    pt0=beams_geo[i].Vertices[0].Location
    pt1=beams_geo[i].Vertices[1].Location
    pt2=beams_geo[i].Vertices[2].Location
    pt3=beams_geo[i].Vertices[3].Location
    mid_pt1=rg.Line(pt0,pt2).PointAt(0.5)
    pt4=beams_geo[i].Vertices[4].Location
    pt5=beams_geo[i].Vertices[5].Location
    pt6=beams_geo[i].Vertices[6].Location
    pt7=beams_geo[i].Vertices[7].Location
    mid_pt2=rg.Line(pt4,pt6).PointAt(0.5)
    axis_vec=rg.Vector3d.Subtract(rg.Vector3d(mid_pt1),rg.Vector3d(mid_pt2))
    pl1_pt1=rg.Line(pt0,pt1).PointAt(0.5)
    pl1_pt2=rg.Line(pt0,pt3).PointAt(0.5)
    pl1_vec1=rg.Vector3d.Subtract(rg.Vector3d(mid_pt1),rg.Vector3d(pl1_pt1))
    pl1_vec2=rg.Vector3d.Subtract(rg.Vector3d(mid_pt1),rg.Vector3d(pl1_pt2))
    pl2_pt1=rg.Line(pt4,pt5).PointAt(0.5)
    pl2_pt2=rg.Line(pt4,pt7).PointAt(0.5)
    pl2_vec1=rg.Vector3d.Subtract(rg.Vector3d(mid_pt2),rg.Vector3d(pl2_pt1))
    pl2_vec2=rg.Vector3d.Subtract(rg.Vector3d(mid_pt2),rg.Vector3d(pl2_pt2))
    pl1=rg.Plane(mid_pt1,pl1_vec1,pl1_vec2)
    pl2=rg.Plane(mid_pt2,pl2_vec1,pl2_vec2)
    beam_mesh=rg.Mesh()
    for mesh in (rg.Mesh.CreateFromBrep(beams_geo[i])):
        beam_mesh.Append(mesh)
    beam_object=beam.Beam({"init_end_pts": [mid_pt1,mid_pt2], "end_planes": [pl1,pl2],
                          "dim": [0.07,0.07], "zAxis": axis_vec, "type": None,
                          "parent_bar": None, "parent_building": None,
                          "is_corner_vertical": False, "is_corner_diagonal": False,
                          "corner_diagonal_aligned_edge": None,
                          "is_opening_beam": False,
                          "parent_floor": None,
                          "parent_walls": [], "parent_slabs": [],
                          "is_window_main_beam": False,
                          "is_window_cross_beam": False,
                          "parent_module": None,
                          "ref_side_edge": None, 
                          "mesh": beam_mesh })
    beams.append(beam_object)
    beam_meshes.append(beam_object.mesh)
# ---------- end python ----------
python_2 = PythonScript(beams_geo=brep, sel_beam=list)  # -> out, beams, beam_meshes; inputs beams_geo: list of Brep
# ---------- python_2: Python ----------
from tolerance_analysis import beam
from compas_fab.fab.grasshopper.utilities import unload_modules 
unload_modules('tolerance_analysis')
unload_modules('spatial_timber_assemblies')
import rhinoscriptsyntax as rs
import Rhino.Geometry as rg
import scriptcontext as sc
tolerance = sc.doc.ModelAbsoluteTolerance

beams=[]
beam_meshes=[]
for i in range(len(beams_geo)):
    """
    pt1----pt0     pt4----pt5           
    !        !     !       !
    ! mid_pt1!     !mid_pt2!
    !        !     !       !
    pt2----pt3     pt7----pt6
    """
    pt0=beams_geo[i].Vertices[0].Location
    pt1=beams_geo[i].Vertices[1].Location
    pt2=beams_geo[i].Vertices[2].Location
    pt3=beams_geo[i].Vertices[3].Location
    mid_pt1=rg.Line(pt0,pt2).PointAt(0.5)
    pt4=beams_geo[i].Vertices[4].Location
    pt5=beams_geo[i].Vertices[5].Location
    pt6=beams_geo[i].Vertices[6].Location
    pt7=beams_geo[i].Vertices[7].Location
    mid_pt2=rg.Line(pt4,pt6).PointAt(0.5)
    #axis_vec=rg.Vector3d.Subtract(rg.Vector3d(mid_pt1),rg.Vector3d(mid_pt2))
    
    mesh=rg.Mesh.CreateFromBrep(beams_geo[i])[3]
    axis_vec=mesh.Normals[0]
    pl1_pt1=rg.Line(pt2,pt3).PointAt(0.5)
    pl1_pt2=rg.Line(pt3,pt0).PointAt(0.5)
    pl1_vec1=rg.Vector3d.Subtract(rg.Vector3d(mid_pt1),rg.Vector3d(pl1_pt1))
    pl1_vec2=rg.Vector3d.Subtract(rg.Vector3d(mid_pt1),rg.Vector3d(pl1_pt2))
    pl2_pt1=rg.Line(pt4,pt5).PointAt(0.5) #7-5
    pl2_pt2=rg.Line(pt4,pt7).PointAt(0.5)
    pl2_vec1=rg.Vector3d.Subtract(rg.Vector3d(mid_pt2),rg.Vector3d(pl2_pt1))
    pl2_vec2=rg.Vector3d.Subtract(rg.Vector3d(mid_pt2),rg.Vector3d(pl2_pt2))
    pl1=rg.Plane(mid_pt1,pl1_vec1,pl1_vec2)
    pl2=rg.Plane(mid_pt2,pl2_vec1,pl2_vec2)
    beam_mesh=rg.Mesh()
    for mesh in (rg.Mesh.CreateFromBrep(beams_geo[i])):
        beam_mesh.Append(mesh)
        
    beam_object=beam.Beam({"init_end_pts": [mid_pt1, mid_pt2], "end_planes": [pl1,pl2],
                          "dim": [0.07,0.07], "zAxis": axis_vec, "type": None,
                          "parent_bar": None, "parent_building": None,
                          "is_corner_vertical": False, "is_corner_diagonal": False,
                          "corner_diagonal_aligned_edge": None,
                          "is_opening_beam": False,
                          "parent_floor": None,
                          "parent_walls": [], "parent_slabs": [],
                          "is_window_main_beam": False,
                          "is_window_cross_beam": False,
                          "parent_module": None,
                          "ref_side_edge": None, 
                          "mesh": beam_mesh, "beam_vertices": [pt0, pt1, pt2, pt3, pt4, pt5, pt6, pt7] })
    beams.append(beam_object)
    beam_meshes.append(beam_object.mesh)
a=[]
a.append(beams[int(sel_beam)].end_planes[0])
a.append(beams[int(sel_beam)].end_planes[1])
b=beams[int(sel_beam)].frame

print beams[0]
# ---------- end python_2 ----------
list_2 = ValueList({"0", "1", "2", "3", "4", "5"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}, selected="0")
item = ListItem(List=python_2.beam_meshes, Index=list_2, Wrap=True)
list_3 = ValueList({"0", "1", "2", "3", "4", "5", "6", "7", "8", "9"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}, selected="5")
crv = Curve([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])
crv_2 = Curve([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])
python_3 = PythonScript(beams=python_2.beams, edges=crv, joints=crv_2, selected_beam=list_3, generate_TextDot=Toggle(False))  # -> edge_joint, edge_beam, edge_connected, topology_edges, assembly_sequence, topology_edges_2, beam_mesh; inputs beams: list, edges: list of Curve, joints: list of Curve, selected_beam: Int32
# ---------- python_3: Python ----------
from tolerance_analysis import ToleranceNetwork
from compas_fab.fab.grasshopper.utilities import unload_modules 
unload_modules('tolerance_analysis')
from compas_fab.fab.geometry import Frame, Transformation
from compas.geometry.elements import Line
import rhinoscriptsyntax as rs
import Rhino.Geometry as rg
import Rhino
import scriptcontext as sc
import json
from System import Guid
from compas_fab.fab.grasshopper.utilities.drawing import xdraw_frame

#Generate Text Dot with the Beams order
if generate_TextDot==True:
    generated_textDot_list=[]
    for edge in edges:
        sc.doc = Rhino.RhinoDoc.ActiveDoc 
        generated_textDot_list.append(rs.AddTextDot("1",rs.CurveMidPoint(edge)))
        sc.doc = ghdoc
    data=[]
    for guid in generated_textDot_list:
        data.append(str(guid))
    with open(r"C:/Users/gandiaa/Documents/projects/tolerance_analysis/data170521.json", 'w') as filename:
        json.dump(data, filename)
with open(r"C:/Users/gandiaa/Documents/projects/tolerance_analysis/data170521.json", 'r') as filename:
    restored_data = json.load(filename)

#Filter DotText objects
objs = restored_data
textDotIDs=[]
for objsID in objs:
    if rs.IsTextDot(Guid.Parse(objsID))==True:
        textDotIDs.append(Guid.Parse(objsID))

#Get text from DotText
weights_list=[]
textDot_list=[]
for objsID in objs:
    weights_list.append(int(Rhino.RhinoDoc.ActiveDoc.Objects.Find(Guid.Parse(objsID)).Geometry.Text))
    textDot_list.append(Rhino.RhinoDoc.ActiveDoc.Objects.Find(Guid.Parse(objsID)).Geometry)

#Prepare edges and joints for Network
joint_list=[]
for joint in joints:
    joint_list.append(Line(joint.PointAtStart,joint.PointAtEnd))
edge_list=[]
for edge in edges:
    edge_list.append(Line(edge.PointAtStart,edge.PointAtEnd))

#Build Network
tolerance_network=ToleranceNetwork(joint_list, edge_list, beams, weights_list)

edge_joint=[]
for u,v,attr in tolerance_network.edges(data=True):
    if attr['edge_type']=='joint':
        coords_1 = tolerance_network.vertex_coordinates(u)
        coords_2 = tolerance_network.vertex_coordinates(v)
        pt_1 = rg.Point3d(coords_1[0],coords_1[1],coords_1[2])
        pt_2 = rg.Point3d(coords_2[0],coords_2[1],coords_2[2])
        edge_joint.append(rg.Line(pt_1,pt_2))

edge_beam=[]
for u,v,attr in tolerance_network.edges(data=True):
    if attr['edge_type']=='member':
        coords_1 = tolerance_network.vertex_coordinates(u)
        coords_2 = tolerance_network.vertex_coordinates(v)
        pt_1 = rg.Point3d(coords_1[0],coords_1[1],coords_1[2])
        pt_2 = rg.Point3d(coords_2[0],coords_2[1],coords_2[2])
        edge_beam.append(rg.Line(pt_1,pt_2))

#Iterate connectivity list according to slider and display edge selected and connected edges
connectivity_edges=[]
for u,v,attr in tolerance_network.edges(data=True):
    if attr['edge_type']=='member':
        temp_connectivity_edges=[]
        for connected_edge in attr['member_edge_nbrs']: 
            coords_1=tolerance_network.vertex_coordinates(connected_edge[0])
            coords_2=tolerance_network.vertex_coordinates(connected_edge[1])
            pt_1 = rg.Point3d(coords_1[0],coords_1[1],coords_1[2])
            pt_2 = rg.Point3d(coords_2[0],coords_2[1],coords_2[2])
            temp_connectivity_edges.append(rg.Line(pt_1,pt_2))
        coords_1=tolerance_network.vertex_coordinates(u)
        coords_2=tolerance_network.vertex_coordinates(v)
        pt_1 = rg.Point3d(coords_1[0],coords_1[1],coords_1[2])
        pt_2 = rg.Point3d(coords_2[0],coords_2[1],coords_2[2])
        temp_connectivity_edges.append(rg.Line(pt_1,pt_2))
        connectivity_edges.append(temp_connectivity_edges)
#edge_connected=connectivity_edges[selected_beam]

#Display vertex as beam (beam_vertex) and edges as connections (topology_edges)

beam_vertex_list=[]
topology_edges=[]
for u, attr in tolerance_network.assembly_sequence_network.vertices(data=True):
    pt_1 = rg.Point3d(attr['x'],attr['y'],attr['z'])
    beam_vertex_list.append(pt_1)
    for vertex in tolerance_network.assembly_sequence_network.adjacency_dictionary[u]:
        coords_2= tolerance_network.assembly_sequence_network.vertex_coordinates(vertex)
        pt_2 = rg.Point3d(coords_2[0],coords_2[1],coords_2[2])
        topology_edges.append(rg.Line(pt_1,pt_2))

#Iterate according result order
beam_mesh=[]
vertices_list=[]
for u,v,attr in tolerance_network.edges(data=True):
    if attr['edge_type']=='member':
        beam_mesh.append(attr['beam'].mesh)

assembly_sequence=[]
for i in range(selected_beam+1):
    mst_index=tolerance_network.result[i]
    assembly_sequence.append(beam_mesh[int(mst_index)])

"""
transformations=[]
for i in tolerance_network.transformations:
    transformations.append(xdraw_frame(Frame.from_transformation(i)))
a=transformations
"""
# ---------- end python_3 ----------
generate_beam_number = PythonScript(edges=crv, generate=Toggle(False))  # -> out, a, b; inputs edges: list of Curve, generate: Boolean
# ---------- generate_beam_number: Python ----------
from compas_fab.fab.geometry import Frame, Transformation
from compas.geometry.elements import Line
from compas.geometry.elements import Point
from compas.geometry.elements import Vector
import rhinoscriptsyntax as rs
import Rhino.Geometry as rg
import Rhino
import scriptcontext as sc
print generate
if generate==True:
    sc.doc = Rhino.RhinoDoc.ActiveDoc
    for index, edge in enumerate(edges):
        rs.AddTextDot(str(index),rs.CurveMidPoint(edge))
    sc.doc = ghdoc
    #    generated_textDot_list.append(rs.AddTextDot("0",rs.CurveMidPoint(edge)))
# ---------- end generate_beam_number ----------
generate_beam_axes = PythonScript(beams=python_2.beams)  # -> out, a, b; inputs beams: list
# ---------- generate_beam_axes: Python ----------
from compas_fab.fab.geometry import Frame, Transformation
from compas.geometry.elements import Line
from compas.geometry.elements import Point
from compas.geometry.elements import Vector
import rhinoscriptsyntax as rs
import Rhino.Geometry as rg
import scriptcontext as sc

beam_axes=[]
beams_meshes=[]
for beam in beams:
    pt1=beam.axis_end_points[0]
    pt2=beam.axis_end_points[1]
    axis_vec_1=beam.axis_vec*(100)
    axis_vec_2=beam.axis_vec*(-100)
    new_pt1=rg.Vector3d.Add(rg.Vector3d(pt1),axis_vec_1) 
    new_pt2=rg.Vector3d.Add(rg.Vector3d(pt2),axis_vec_2) 
    beam_axis=rg.Line(rg.Point3d(new_pt1),rg.Point3d(new_pt2))
    beam_axes.append(beam_axis)
    beams_meshes.append(beam.mesh)
a=beam_axes
b=beams_meshes
# ---------- end generate_beam_axes ----------
line = Line(python_3.edge_connected)
line_2 = Line(python_3.edge_joint)
line_3 = Line(python_3.edge_beam)
line_4 = Line(python_3.topology_edges)
mesh = Mesh(python_3.assembly_sequence)
line_5 = Line(python_3.topology_edges_2)
# Lines ordered as the beams(input)
# Lines are randomly drawn by hand. They are used to stablish connectivity
preview = CustomPreview(
    Geometry=line_4,
    Shader={ambient=RGB(0, 0, 0), diffuse=RGB(255, 105, 180), emission=RGB(76, 32, 54), shine=0.5, specular=RGB(255, 255, 255), transparency=0})
